# Grasshopper definition DynamicRelaxation_spiralbent.gh (Grasshopper 0.9.64)
# plug-ins: Python Interpreter

amplitude = Slider(2, range=0..10)
amplitude_2 = Slider(10, range=0..10)
frequency = Slider(2, range=0..12)
length = Slider(50, range=0..50)
number_slider = Slider(30, range=0..100)
subdiv = Slider(6, range=0..10)
range = Range(Domain=length, Steps=number_slider)

pi = Pi(Factor=expr("N/2", frequency))
division = Division(A=pi, B=length)
multiplication = Multiplication(A=division, B=range)
cos = Cosine(Value=multiplication)
sin = Sine(Value=multiplication)
multiplication_2 = Multiplication(A=amplitude_2, B=cos)
multiplication_3 = Multiplication(A=amplitude_2, B=sin)

multiplication_4 = Multiplication(A=division, B=range)
sin_2 = Sine(Value=multiplication_4)
multiplication_5 = Multiplication(A=amplitude, B=sin_2)
pt = ConstructPoint(XCoordinate=range, YCoordinate=multiplication_2, ZCoordinate=multiplication_3)
pt_2 = ConstructPoint(XCoordinate=range, YCoordinate=0, ZCoordinate=multiplication_5)

entwine = Entwine(Branch00=pt, Branch01=pt_2)
series = Series(Start=0, Step=1, Count=expr("C+1", number_slider))
graft = GraftTree(Tree=series, IncludeEmptyLists=True, IncludeNullItems=True)
viewer = ParamViewer(entwine)
item = TreeItem(Tree=entwine, Path=viewer, Index=graft, Wrap=True)
pline = PolyLine(Vertices=item, Closed=False)

divide = DivideCurve(Curve=pline, Count=subdiv, Kinks=False)  # -> Points, Tangents, Parameters
series_2 = Series(Start=0, Step=1, Count=expr("C+1", subdiv))
viewer_2 = ParamViewer(divide.Points)
graft_2 = GraftTree(Tree=series_2, IncludeEmptyLists=True, IncludeNullItems=True)
item_2 = TreeItem(Tree=divide.Points, Path=viewer_2, Index=graft_2, Wrap=True)
pline_2 = PolyLine(Vertices=item_2, Closed=False)

viewer_3 = ParamViewer(pline_2)
lng = ListLength(List=viewer_3)  # -> expr("L-1", Length)
concat = Concatenate(FragmentA="{0;0;(0,", FragmentB=lng)
concat_2 = Concatenate(FragmentA=concat, FragmentB=")}")

pline_3 = PolyLine(Vertices=divide.Points, Closed=False)

viewer_4 = ParamViewer(pline_3)
lng_2 = ListLength(List=viewer_4)  # -> expr("L-1", Length)
concat_3 = Concatenate(FragmentA="{0;0;(0,", FragmentB=lng_2)
concat_4 = Concatenate(FragmentA=concat_3, FragmentB=");0}")

split = SplitTree(Data=pline_2, Masks=flatten(concat_2))  # -> Positive, Negative
split_2 = SplitTree(Data=pline_3, Masks=flatten(concat_4))  # -> Positive, Negative
bang = ExplodeTree(Data=split.Positive)  # -> Branch0, Branch1

end = EndPoints(Curve=pline_2)  # -> Start, End
cp = ControlPoints(Curve=bang.Branch0)  # -> Points, Weights, Knots
item_3 = ListItem(List=cp.Points, Index=[1, -2], Wrap=True)
flatten = FlattenTree(Tree=[end.Start, end.End, item_3], Path="{0}")

flatten_2 = FlattenTree(Tree=[bang.Branch1, bang.Branch0], Path="{0}")
flatten_3 = FlattenTree(Tree=[split_2.Negative, split.Negative], Path="{0}")
list = ValueList({"Circular Solid": 1, "Circular Tube": 2, "Rectangular Solid": 3}, selected="Circular Tube")
trigger = Slider(100, range=0..1000)
newtons = Slider(10, range=0..25000)
newtons_2 = Slider(9935.225, range=0..25000)
python = PythonScript(trigger=trigger, before=newtons, after=newtons_2)  # -> out, a
# ---------- python: Python ----------
if x > trigger:
    a = after
else:
    a = before
# ---------- end python ----------
area_moments_of_inertia_calculator = PythonScript(
    type=list,
    innerRadius=Slider(2, range=0..10),
    outerRadius=Slider(3, range=0..10),
    width=Slider(0.25, range=0..10),
    height=Slider(0.25, range=0..10))  # -> out, I
# ---------- area_moments_of_inertia_calculator: Python ----------
import math

def circular(r):
    return (math.pi/4)*math.pow(r,4)
    
def circularTube(r1, r2):
    print math.pow(r2,4) - math.pow(r1, 4)
    return (math.pi/4)*(math.pow(r2,4) - math.pow(r1, 4))

def rectangle(w,h):
    return (w*math.pow(h,3))/12

if type == 1:
    I = circular(outerRadius)
elif type == 2:
    I = circularTube(innerRadius, outerRadius)
elif type == 3:
    I = rectangle(width, height)
# ---------- end area_moments_of_inertia_calculator ----------
panel = Panel(area_moments_of_inertia_calculator.I)
xy = XYPlane(Origin=Point(0, 0, 0))
# RESTRAINTS
pt_3 = Point(flatten)
pln = Plane()
pt_4 = Point()
pln_2 = Plane(xy)
pt_5 = Point([<point referenced from the Rhino model> x4])
youngs_modulus_of_elasticity_e = Slider(2500, range=0..50000)

# ----
# LOADS
# Loads can be single points or point collections.
# 
# New loads are added in the same manner as described above. Remember to increase the target integer in the path mapper component to the next unique integer.
# 
# Set the force in Newtons, and the direction of the force using X, Y and Z axis rotations.
# LOADS
# LOADS
pt_6 = Point(<point referenced from the Rhino model>)
x_axis_rotation = Slider(0, range=0..360)
y_axis_rotation = Slider(0, range=0..360)
z_axis_rotation = Slider(0, range=0..360)
newtons_3 = Slider(20, range=0..25000)
pt_7 = Point([<point referenced from the Rhino model> x5])
x_axis_rotation_2 = Slider(0, range=0..360)
y_axis_rotation_2 = Slider(0, range=0..360)
# MATERIALS
# & sections
newtons_4 = Slider(20, range=0..25000)
z_axis_rotation_2 = Slider(0, range=0..360)
cluster = Cluster(A=x_axis_rotation, G=pt_6, A_3=z_axis_rotation, A_2=y_axis_rotation, X=newtons_3, d3=pt_6)  # -> V, G_2, V_2, R
cluster_2 = Cluster(A=x_axis_rotation_2, G=pt_7, A_3=z_axis_rotation_2, A_2=y_axis_rotation_2, X=newtons_4, d3=pt_7)  # -> V, G_2, V_2, R
line = LineSDL(Start=pt_6, Direction=cluster.V, Length=expr("abs(L)/500", newtons_3))
line_2 = LineSDL(Start=pt_7, Direction=cluster_2.V, Length=expr("abs(L)/500", newtons_4))
vdis = VectorDisplay(Anchor=cluster.G_2, Vector=cluster.V_2)
vdis_2 = VectorDisplay(Anchor=cluster_2.G_2, Vector=cluster_2.V_2)
path_mapper = PathMapper(cluster.R, source="{0}", target="{0}")
path_mapper_2 = PathMapper(cluster_2.R, source="{0}", target="{1}")
merge = Merge(Data1=path_mapper, Data2=path_mapper_2)

coefficient = Slider(0.95, range=0..1)

# ----
# pre specified materials
youngs_modulus_of_elasticity_e_2 = Slider(1584.164, range=0..50000)
youngs_modulus_of_elasticity_e_3 = Slider(2500, range=0..50000)
# Materials & sections can be chosen from the list of prespecified materials or user defined.
# 
# Add new material in the same manner as described above.
# 
# All materials have by default 5 parameters.  However, these are not all used by each material. For example, membrane materials do not take a value for second moment of inertia.  In these cases, the set value is ignored.
youngs_modulus_of_elasticity_e_4 = Slider(3500, range=0..50000)
coefficient_2 = Slider(0.05, range=0..1)
second_moment_of_inertia_i = Slider(0.81, range=0..1000)
second_moment_of_inertia_i_2 = Slider(0.81, range=0..1000)
neutral_axis_distance = Slider(0.375, range=0..10)
neutral_axis_distance_2 = Slider(0.25, range=0..10)
second_moment_of_inertia_i_3 = Slider(0.785, range=0..1000)
coefficient_3 = Slider(1, range=0..1)
neutral_axis_distance_3 = Slider(1, range=0..10)
sectional_area_a = Slider(0.25, range=0..200)
sectional_area_a_2 = Slider(0.01, range=0..200)
sectional_area_a_3 = Slider(3.142, range=0..200)
user_material = PythonScript(
    NAME="MATERIAL TWO",
    E=youngs_modulus_of_elasticity_e_2,
    A=sectional_area_a,
    I=second_moment_of_inertia_i,
    C=coefficient,
    D=neutral_axis_distance)  # -> out, MAT
# ---------- user_material: Python ----------
output = []

output.append(NAME)
if E is not None:
    output.append(E)
else:
    output.append(1)
if A is not None:
    output.append(A)
else:
    output.append(1)
if I is not None:
    output.append(I)
else:
    output.append(1)
if C is not None:
    output.append(C)
else:
    output.append(1)
if D is not None:
    output.append(D)
else:
    output.append(1)

MAT = output
# ---------- end user_material ----------
user_material_2 = PythonScript(
    NAME="MATERIAL THREE",
    E=youngs_modulus_of_elasticity_e_3,
    A=sectional_area_a_2,
    I=second_moment_of_inertia_i_2,
    C=coefficient_2,
    D=neutral_axis_distance_2)  # -> out, MAT; same code as user_material
user_material_3 = PythonScript(
    NAME="MATERIAL ONE",
    E=youngs_modulus_of_elasticity_e_4,
    A=sectional_area_a_3,
    I=second_moment_of_inertia_i_3,
    C=coefficient_3,
    D=neutral_axis_distance_3)  # -> out, MAT
# ---------- user_material_3: Python ----------
output = []

output.append(NAME)
if E is not None:
    output.append(E)
else:
    output.append(-1)
if A is not None:
    output.append(A)
else:
    output.append(-1)
if I is not None:
    output.append(I)
else:
    output.append(-1)
if C is not None:
    output.append(C)
else:
    output.append(-1)
if D is not None:
    output.append(D)
else:
    output.append(-1)

MAT = output
# ---------- end user_material_3 ----------
list_2 = ValueList({"GFRP_D2": 0, "GFRP_D3": 1, "STEEL_D2": 2, "RATTAN_D6": 3, "RATTAN_D10": 4, "WOOD_2x20": 5, "MEMBRANE": 6, "PVC_D2": 7}, selected=["GFRP_D2", "GFRP_D3", "STEEL_D2", "RATTAN_D6", "RATTAN_D10", "WOOD_2x20", "MEMBRANE", "PVC_D2"])
path_mapper_3 = PathMapper(user_material.MAT, source="{0;0}", target="{1}")
path_mapper_4 = PathMapper(user_material_2.MAT, source="{0;0}", target="{2}")
path_mapper_5 = PathMapper(user_material_3.MAT, source="{0;0}", target="{0}")

coefficient_4 = Slider(0.11, range=0..1)
second_moment_of_inertia_i_4 = Slider(0.81, range=0..1000)
neutral_axis_distance_4 = Slider(0.25, range=0..10)
crv = Curve()
crv_2 = Curve(<curve referenced from the Rhino model>)
pt_8 = Point()
pt_9 = Point(<point referenced from the Rhino model>)
sectional_area_a_4 = Slider(0.1, range=0..200)
pt_10 = Point(<point referenced from the Rhino model>)
# Line Constrained Pin Joints
vec = Vector()
pt_11 = Point()
vec_2 = Vector()
merge_2 = Merge(Data1=vec, Data2=pt_10)
merge_3 = Merge(Data1=vec_2, Data2=pt_11)
path_mapper_6 = PathMapper(merge_2, source="{0}", target="{0}")
path_mapper_7 = PathMapper(merge_3, source="{0}", target="{1}")
panel_2 = Panel(pt_3)
crv_3 = Curve([<curve referenced from the Rhino model> x4])
user_material_4 = PythonScript(
    NAME="MATERIAL FOUR",
    E=youngs_modulus_of_elasticity_e,
    A=sectional_area_a_4,
    I=second_moment_of_inertia_i_4,
    C=coefficient_4,
    D=neutral_axis_distance_4)  # -> out, MAT; same code as user_material
crv_4 = Curve([<curve referenced from the Rhino model> x2])
crv_5 = Curve()
crv_6 = Curve(flatten_2)

# ----
# ELEMENTS
# Elements can be beam, truss or cable elements.
# 
# To make a new element collection, copy paste the naming panel, the curve collection and the path mapper (everything before the merge component). Increase the target value of the path mapper to the next unique integer.  Select new curves and name as appropriate.
# Beam Elements
panel_3 = Panel("RATTAN_D10")
path_mapper_8 = PathMapper([panel_3, crv_6], source="{0}", target="{0}")
path_mapper_9 = PathMapper("STEEL_D2", source="{0}", target="{1}")
merge_4 = Merge(Data1=path_mapper_8, Data2=path_mapper_9)

crv_7 = Curve()
crv_8 = Curve(flatten_3)

# ----
# Cable Elements
# (& membranes)
panel_4 = Panel("MATERIAL THREE")
path_mapper_10 = PathMapper([panel_4, crv_8], source="{0}", target="{0}")
path_mapper_11 = PathMapper(["MATERIAL FOUR", crv_5], source="{0}", target="{1}")
merge_5 = Merge(Data1=path_mapper_10, Data2=path_mapper_11)

path_mapper_12 = PathMapper(["MATERIAL FOUR", crv_7], source="{0}", target="{2}")

# ----
# Truss Elements
panel_5 = Panel("MATERIAL THREE")
path_mapper_13 = PathMapper(panel_5, source="{0}", target="{0}")
path_mapper_14 = PathMapper("MATERIAL TWO", source="{0}", target="{1}")
merge_6 = Merge(Data1=path_mapper_13, Data2=path_mapper_14, Data3=path_mapper_12)

path_mapper_15 = PathMapper(user_material_4.MAT, source="{0;0}", target="{3}")
merge_7 = Merge(Data1=path_mapper_6, Data2=path_mapper_7)
panel_6 = Panel(merge_7)
merge_8 = Merge(Data1=path_mapper_5, Data2=path_mapper_3, Data3=path_mapper_4, Data4=path_mapper_15)

vb = VBScript()  # -> out, File, Folder
# ---------- vb: C# ----------
    File = "<unset>"
    Folder = "<unset>"

    If (String.IsNullOrEmpty(GrasshopperDocument.FilePath)) Then Return

    Try
      File = GrasshopperDocument.FilePath
      Folder = IO.Path.GetDirectoryName(GrasshopperDocument.FilePath) & IO.Path.DirectorySeparatorChar
    Catch
    End Try
# ---------- end vb ----------
panel_7 = Panel(vb.Folder)
concat_5 = Concatenate(FragmentA=panel_7, FragmentB="DynamicRelaxationComponent.py")
file = ReadFile(File=concat_5, PerLineParse=False)

concat_6 = Concatenate(FragmentA=panel_7, FragmentB="DynamicRelaxationMaterialsComponent.py")
file_2 = ReadFile(File=concat_6, PerLineParse=False)
python_2 = PythonScript(Code=file_2, PreSpecified=list_2, UserDefined=merge_8)  # -> Out, A
run = BooleanToggle(True)
reset = BooleanToggle(False)
adjust_forces = BooleanToggle(False)
step_size = Slider(2000, range=1..50000)
timer = Timer(TimerInterval=2, Target=dynamic_relaxation_engine)

# ----
# Pin Joints
# Rail Constrained Pin Joints
# Plane Constrained Pin Joints
deplane = DeconstructPlane(Plane=pln)  # -> Origin, XAxis, YAxis, ZAxis
deplane_2 = DeconstructPlane(Plane=pln_2)  # -> Origin, XAxis, YAxis, ZAxis
merge_9 = Merge(Data1=crv_2, Data2=pt_9)
merge_10 = Merge(Data1=crv, Data2=pt_8)
path_mapper_16 = PathMapper(merge_9, source="{0}", target="{0}")
path_mapper_17 = PathMapper(merge_10, source="{0}", target="{1}")
merge_11 = Merge(Data1=path_mapper_16, Data2=path_mapper_17)

pt_12 = Point(deplane.ZAxis)
pt_13 = Point(deplane_2.ZAxis)

merge_12 = Merge(Data1=pt_13, Data2=pt_5)
merge_13 = Merge(Data1=pt_12, Data2=pt_4)
path_mapper_18 = PathMapper(merge_12, source="{0}", target="{0}")
path_mapper_19 = PathMapper(merge_13, source="{0}", target="{1}")
merge_14 = Merge(Data1=path_mapper_18, Data2=path_mapper_19)

panel_8 = Panel(merge_11)
dynamic_relaxation_engine = PythonScript(
    Code=file,
    Beams=merge_4,
    Trusses=merge_6,
    Cables=merge_5,
    Loads=merge,
    PinnedPoints=pt_3,
    LineConstrainedPoints=merge_7,
    RailConstrainedPoints=merge_11,
    PlaneConstrainedPoints=merge_14,
    Materials=python_2.A,
    Run=run,
    Reset=reset,
    Step=step_size,
    Adjust=adjust_forces)  # -> Out, BeamsOUT, TrussesOUT, CablesOUT, StressOUT, StressMinMax, LoadsOUT, LoadsDirOUT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
panel_9 = Panel(dynamic_relaxation_engine.StepCounter)
pt_14 = Point(dynamic_relaxation_engine.LoadsOUT)
crv_9 = Curve(dynamic_relaxation_engine.TrussesOUT)
pt_15 = Point(dynamic_relaxation_engine.Particles)
vdis_3 = VectorDisplay(Anchor=pt_14, Vector=dynamic_relaxation_engine.LoadsDirOUT)
item_4 = ListItem(List=dynamic_relaxation_engine.StressMinMax, Index=1, Wrap=True)
item_5 = ListItem(List=dynamic_relaxation_engine.StressMinMax, Index=0, Wrap=True)
panel_10 = Panel(dynamic_relaxation_engine.Out)
gradient = Gradient(
    LowerLimit=item_5,
    UpperLimit=item_4,
    Parameter=dynamic_relaxation_engine.StressOUT,
    stops=[0: RGB(0, 0, 255), 0.494: RGB(255, 128, 0), 1: RGB(255, 0, 0)])
explode = Explode(Curve=dynamic_relaxation_engine.BeamsOUT, Recursive=True)  # -> Segments, Vertices
preview = CustomPreview(Geometry=explode.Segments, Shader=gradient)
crv_10 = Curve(dynamic_relaxation_engine.BeamsOUT)
pt_16 = Point(dynamic_relaxation_engine.FixedPointsOUT)
crv_11 = Curve(dynamic_relaxation_engine.CablesOUT)

# ==== cluster Cluster
line = LineSDL(Start=Point(0, 0, 0), Direction=Vector(1, 0, 0), Length=1)
line_2 = LineSDL(Start=Point(0, 0, 0), Direction=Vector(0, 1, 0), Length=1)
line_3 = LineSDL(Start=Point(0, 0, 0), Direction=Vector(0, 0, 1), Length=1)
line_4 = LineSDL(Start=Point(0, 0, 0), Direction=Vector(0, 0, 1), Length=1)
A = ClusterInput()
X = ClusterInput()
vrot = Rotate(Vector=line_4, Axis=line, Angle=degrees(A))
vec = VectorXYZ(XComponent=X, YComponent=0, ZComponent=0)  # -> Vector, Length
A_2 = ClusterInput()
A_3 = ClusterInput()
vrot_2 = Rotate(Vector=vrot, Axis=line_2, Angle=degrees(A_2))
vrot_3 = Rotate(Vector=vrot_2, Axis=line_3, Angle=degrees(A_3))
G = ClusterInput()
rev = Reverse(Vector=vrot_3)
V = ClusterOutput(vrot_3)
d3 = ClusterInput()
move = Move(Geometry=G, Motion=vrot_3)  # -> Geometry, Transform
V_2 = ClusterOutput(rev)
merge = Merge(Data1=rev, Data2=vec.Vector, Data3=d3)
G_2 = ClusterOutput(move.Geometry)
R = ClusterOutput(merge)
