# Grasshopper definition DynamicRelaxation_complexitytest.gh (Grasshopper 0.9.64)
# plug-ins: Python Interpreter

number_slider = Slider(3, range=0..10)
multiplication = Multiplication(A=Slider(1, range=0..20), B=2)
addition = Addition(A=multiplication, B=1)
radgrid = Radial(Plane=PlaneXY(0, 0, 0), Size=Slider(10, range=0..10), ExtentR=addition, ExtentP=Slider(6, range=0..100))  # -> Cells, Points
flip = FlipMatrix(Data=radgrid.Points)
dom = ConstructDomain(DomainStart=1, DomainEnd=addition)
neg = Negative(Value=number_slider)
subset = SubList(List=flip, Domain=dom, Wrap=False)  # -> List, Index
Z = UnitZ(Factor=number_slider)
multiplication_2 = Multiplication(A=Slider(2, range=1..3), B=multiplication)
Z_2 = UnitZ(Factor=neg)
dispatch = Dispatch(List=subset.List, DispatchPattern=[True, False])  # -> ListA, ListB
dispatch_2 = Dispatch(List=dispatch.ListB, DispatchPattern=[True, False])  # -> ListA, ListB
move = Move(Geometry=dispatch_2.ListA, Motion=Z)  # -> Geometry, Transform
move_2 = Move(Geometry=dispatch_2.ListB, Motion=Z_2)  # -> Geometry, Transform
weave = Weave(Pattern=[0, 1], Stream0=move.Geometry, Stream1=move_2.Geometry, NullGaps=False)
weave_2 = Weave(Pattern=[0, 1], Stream0=dispatch.ListA, Stream1=weave, NullGaps=False)
intcrv = Interpolate(Vertices=weave_2, Degree=3, Periodic=False, KnotStyle=1)  # -> Curve, Length, Domain
divide = DivideCurve(Curve=intcrv.Curve, Count=multiplication_2, Kinks=False)  # -> Points, Tangents, Parameters
pline = PolyLine(Vertices=divide.Points, Closed=False)
pline_2 = PolyLine(Vertices=dispatch.ListA, Closed=False)
flatten = FlattenTree(Tree=pline_2, Path="{0}")
flatten_2 = FlattenTree(Tree=pline, Path="{0}")
shift = ShiftList(List=flatten, Shift=1, Wrap=True)
end = EndPoints(Curve=flatten_2)  # -> Start, End
item = ListItem(List=divide.Points, Index=1, Wrap=True)
crv = Curve(shift)
crv_2 = Curve(flatten)
flatten_3 = FlattenTree(Tree=[end.Start, item], Path="{0}")
explode = Explode(Curve=crv, Recursive=True)  # -> Segments, Vertices
explode_2 = Explode(Curve=crv_2, Recursive=True)  # -> Segments, Vertices
simplify = SimplifyTree(Tree=explode.Segments, Front=False)
simplify_2 = SimplifyTree(Tree=explode_2.Segments, Front=False)
int = Integer(Slider(8, range=0..10))
int_2 = Integer(Slider(4, range=0..10))
divide_2 = DivideCurve(Curve=simplify_2, Count=int, Kinks=False)  # -> Points, Tangents, Parameters
divide_3 = DivideCurve(Curve=simplify, Count=int, Kinks=False)  # -> Points, Tangents, Parameters
reverse = Boolean(False)
gate = StreamGate(Stream=divide_3.Points, Gate=reverse)  # -> Target0, Target1
rev = ReverseList(List=gate.Target1)
pt = Point(flatten_3)

graft = GraftTree(Tree=divide_2.Points, IncludeEmptyLists=True, IncludeNullItems=True)
graft_2 = GraftTree(Tree=[rev, gate.Target0], IncludeEmptyLists=True, IncludeNullItems=True)
merge = Merge(Data1=graft_2, Data2=graft)
pline_3 = PolyLine(Vertices=merge, Closed=False)

divide_4 = DivideCurve(Curve=pline_3, Count=int_2, Kinks=False)  # -> Points, Tangents, Parameters
trim = TrimTree(Tree=divide_4.Points, Depth=1)
pline_4 = PolyLine(Vertices=trim, Closed=False)
trim_2 = TrimTree(Tree=pline_4, Depth=1)

graft_3 = GraftTree(Tree=trim, IncludeEmptyLists=True, IncludeNullItems=True)
path_mapper = PathMapper(graft_3, source="{A;B;C;D}(i)", target="{A;B;D;C}(i)")
trim_3 = TrimTree(Tree=path_mapper, Depth=1)
pline_5 = PolyLine(Vertices=trim_3, Closed=False)
# ELEMENTS
trim_4 = TrimTree(Tree=pline_5, Depth=1)

item_2 = ListItem(List=trim_4, Index=0, Wrap=True)
trim_5 = TrimTree(Tree=item_2, Depth=1)
list = ValueList({"Circular Solid": 1, "Circular Tube": 2, "Rectangular Solid": 3}, selected="Circular Tube")
trigger = Slider(100, range=0..1000)
newtons = Slider(10, range=0..25000)
newtons_2 = Slider(9935.225, range=0..25000)
flatten_4 = FlattenTree(Tree=[trim_4, trim_2], Path="{0}")
python = PythonScript(trigger=trigger, before=newtons, after=newtons_2)  # -> out, a
# ---------- python: Python ----------
if x > trigger:
    a = after
else:
    a = before
# ---------- end python ----------
area_moments_of_inertia_calculator = PythonScript(
    type=list,
    innerRadius=Slider(2, range=0..10),
    outerRadius=Slider(3, range=0..10),
    width=Slider(0.25, range=0..10),
    height=Slider(0.25, range=0..10))  # -> out, I
# ---------- area_moments_of_inertia_calculator: Python ----------
import math

def circular(r):
    return (math.pi/4)*math.pow(r,4)
    
def circularTube(r1, r2):
    print math.pow(r2,4) - math.pow(r1, 4)
    return (math.pi/4)*(math.pow(r2,4) - math.pow(r1, 4))

def rectangle(w,h):
    return (w*math.pow(h,3))/12

if type == 1:
    I = circular(outerRadius)
elif type == 2:
    I = circularTube(innerRadius, outerRadius)
elif type == 3:
    I = rectangle(width, height)
# ---------- end area_moments_of_inertia_calculator ----------
panel = Panel(area_moments_of_inertia_calculator.I)
xy = XYPlane(Origin=Point(0, 0, 0))
# RESTRAINTS
pt_2 = Point(pt)
pln = Plane()
pt_3 = Point()
pln_2 = Plane(xy)
pt_4 = Point([<point referenced from the Rhino model> x4])
youngs_modulus_of_elasticity_e = Slider(2500, range=0..50000)

# ----
# LOADS
# Loads can be single points or point collections.
# 
# New loads are added in the same manner as described above. Remember to increase the target integer in the path mapper component to the next unique integer.
# 
# Set the force in Newtons, and the direction of the force using X, Y and Z axis rotations.
# LOADS
# LOADS
pt_5 = Point(<point referenced from the Rhino model>)
x_axis_rotation = Slider(0, range=0..360)
y_axis_rotation = Slider(0, range=0..360)
z_axis_rotation = Slider(0, range=0..360)
newtons_3 = Slider(20, range=0..25000)
pt_6 = Point([<point referenced from the Rhino model> x5])
x_axis_rotation_2 = Slider(0, range=0..360)
y_axis_rotation_2 = Slider(0, range=0..360)
# MATERIALS
# & sections
newtons_4 = Slider(20, range=0..25000)
z_axis_rotation_2 = Slider(0, range=0..360)
cluster = Cluster(A=x_axis_rotation, G=pt_5, A_3=z_axis_rotation, A_2=y_axis_rotation, X=newtons_3, d3=pt_5)  # -> V, G_2, V_2, R
cluster_2 = Cluster(A=x_axis_rotation_2, G=pt_6, A_3=z_axis_rotation_2, A_2=y_axis_rotation_2, X=newtons_4, d3=pt_6)  # -> V, G_2, V_2, R
line = LineSDL(Start=pt_5, Direction=cluster.V, Length=expr("abs(L)/500", newtons_3))
line_2 = LineSDL(Start=pt_6, Direction=cluster_2.V, Length=expr("abs(L)/500", newtons_4))
vdis = VectorDisplay(Anchor=cluster.G_2, Vector=cluster.V_2)
vdis_2 = VectorDisplay(Anchor=cluster_2.G_2, Vector=cluster_2.V_2)
path_mapper_2 = PathMapper(cluster.R, source="{0}", target="{0}")
path_mapper_3 = PathMapper(cluster_2.R, source="{0}", target="{1}")
merge_2 = Merge(Data1=path_mapper_2, Data2=path_mapper_3)

coefficient = Slider(0.95, range=0..1)

# ----
# pre specified materials
youngs_modulus_of_elasticity_e_2 = Slider(1584.164, range=0..50000)
youngs_modulus_of_elasticity_e_3 = Slider(2500, range=0..50000)
# Materials & sections can be chosen from the list of prespecified materials or user defined.
# 
# Add new material in the same manner as described above.
# 
# All materials have by default 5 parameters.  However, these are not all used by each material. For example, membrane materials do not take a value for second moment of inertia.  In these cases, the set value is ignored.
youngs_modulus_of_elasticity_e_4 = Slider(3500, range=0..50000)
coefficient_2 = Slider(0.099, range=0..1)
second_moment_of_inertia_i = Slider(0.81, range=0..1000)
second_moment_of_inertia_i_2 = Slider(0.81, range=0..1000)
neutral_axis_distance = Slider(0.375, range=0..10)
neutral_axis_distance_2 = Slider(0.25, range=0..10)
second_moment_of_inertia_i_3 = Slider(0.785, range=0..1000)
coefficient_3 = Slider(1, range=0..1)
neutral_axis_distance_3 = Slider(1, range=0..10)
sectional_area_a = Slider(0.25, range=0..200)
sectional_area_a_2 = Slider(0.01, range=0..200)
sectional_area_a_3 = Slider(3.142, range=0..200)
user_material = PythonScript(
    NAME="MATERIAL TWO",
    E=youngs_modulus_of_elasticity_e_2,
    A=sectional_area_a,
    I=second_moment_of_inertia_i,
    C=coefficient,
    D=neutral_axis_distance)  # -> out, MAT
# ---------- user_material: Python ----------
output = []

output.append(NAME)
if E is not None:
    output.append(E)
else:
    output.append(1)
if A is not None:
    output.append(A)
else:
    output.append(1)
if I is not None:
    output.append(I)
else:
    output.append(1)
if C is not None:
    output.append(C)
else:
    output.append(1)
if D is not None:
    output.append(D)
else:
    output.append(1)

MAT = output
# ---------- end user_material ----------
user_material_2 = PythonScript(
    NAME="MATERIAL THREE",
    E=youngs_modulus_of_elasticity_e_3,
    A=sectional_area_a_2,
    I=second_moment_of_inertia_i_2,
    C=coefficient_2,
    D=neutral_axis_distance_2)  # -> out, MAT; same code as user_material
user_material_3 = PythonScript(
    NAME="MATERIAL ONE",
    E=youngs_modulus_of_elasticity_e_4,
    A=sectional_area_a_3,
    I=second_moment_of_inertia_i_3,
    C=coefficient_3,
    D=neutral_axis_distance_3)  # -> out, MAT
# ---------- user_material_3: Python ----------
output = []

output.append(NAME)
if E is not None:
    output.append(E)
else:
    output.append(-1)
if A is not None:
    output.append(A)
else:
    output.append(-1)
if I is not None:
    output.append(I)
else:
    output.append(-1)
if C is not None:
    output.append(C)
else:
    output.append(-1)
if D is not None:
    output.append(D)
else:
    output.append(-1)

MAT = output
# ---------- end user_material_3 ----------
list_2 = ValueList({"GFRP_D2": 0, "GFRP_D3": 1, "STEEL_D2": 2, "RATTAN_D6": 3, "RATTAN_D10": 4, "WOOD_2*20": 5, "MEMBRANE": 6, "PVC_D2": 7}, selected=["GFRP_D2", "GFRP_D3", "STEEL_D2", "RATTAN_D6", "RATTAN_D10", "WOOD_2*20", "MEMBRANE", "PVC_D2"])
path_mapper_4 = PathMapper(user_material.MAT, source="{0;0}", target="{1}")
path_mapper_5 = PathMapper(user_material_2.MAT, source="{0;0}", target="{2}")
path_mapper_6 = PathMapper(user_material_3.MAT, source="{0;0}", target="{0}")

coefficient_4 = Slider(0.05, range=0..1)
second_moment_of_inertia_i_4 = Slider(0.81, range=0..1000)
neutral_axis_distance_4 = Slider(0.25, range=0..10)
crv_3 = Curve()
crv_4 = Curve(<curve referenced from the Rhino model>)
pt_7 = Point()
pt_8 = Point(<point referenced from the Rhino model>)
sectional_area_a_4 = Slider(0.01, range=0..200)
pt_9 = Point(<point referenced from the Rhino model>)
# Line Constrained Pin Joints
vec = Vector()
pt_10 = Point()
vec_2 = Vector()
merge_3 = Merge(Data1=vec, Data2=pt_9)
merge_4 = Merge(Data1=vec_2, Data2=pt_10)
path_mapper_7 = PathMapper(merge_3, source="{0}", target="{0}")
path_mapper_8 = PathMapper(merge_4, source="{0}", target="{1}")
panel_2 = Panel(pt_2)
crv_5 = Curve([<curve referenced from the Rhino model> x4])
user_material_4 = PythonScript(
    NAME="MATERIAL FOUR",
    E=youngs_modulus_of_elasticity_e,
    A=sectional_area_a_4,
    I=second_moment_of_inertia_i_4,
    C=coefficient_4,
    D=neutral_axis_distance_4)  # -> out, MAT; same code as user_material
crv_6 = Curve([<curve referenced from the Rhino model> x2])
crv_7 = Curve()
crv_8 = Curve(flatten_2)

# ----
# Elements can be beam, truss or cable elements.
# 
# To make a new element collection, copy paste the naming panel, the curve collection and the path mapper (everything before the merge component). Increase the target value of the path mapper to the next unique integer.  Select new curves and name as appropriate.
# Beam Elements
panel_3 = Panel("RATTAN_D6")
path_mapper_9 = PathMapper([panel_3, crv_8], source="{0}", target="{0}")
path_mapper_10 = PathMapper("STEEL_D2", source="{0}", target="{1}")
merge_5 = Merge(Data1=path_mapper_9, Data2=path_mapper_10)

crv_9 = Curve()
crv_10 = Curve(flatten_4)

# ----
# Cable Elements
# (& membranes)
panel_4 = Panel("MATERIAL THREE")
path_mapper_11 = PathMapper([panel_4, crv_10], source="{0}", target="{0}")
path_mapper_12 = PathMapper(["MATERIAL FOUR", crv_7], source="{0}", target="{1}")
merge_6 = Merge(Data1=path_mapper_11, Data2=path_mapper_12)

path_mapper_13 = PathMapper(["MATERIAL FOUR", crv_9], source="{0}", target="{2}")

# ----
# Truss Elements
panel_5 = Panel("MATERIAL THREE")
path_mapper_14 = PathMapper(panel_5, source="{0}", target="{0}")
path_mapper_15 = PathMapper("MATERIAL TWO", source="{0}", target="{1}")
merge_7 = Merge(Data1=path_mapper_14, Data2=path_mapper_15, Data3=path_mapper_13)

path_mapper_16 = PathMapper(user_material_4.MAT, source="{0;0}", target="{3}")
merge_8 = Merge(Data1=path_mapper_7, Data2=path_mapper_8)
panel_6 = Panel(merge_8)
merge_9 = Merge(Data1=path_mapper_6, Data2=path_mapper_4, Data3=path_mapper_5, Data4=path_mapper_16)

vb = VBScript()  # -> out, File, Folder
# ---------- vb: C# ----------
    File = "<unset>"
    Folder = "<unset>"

    If (String.IsNullOrEmpty(GrasshopperDocument.FilePath)) Then Return

    Try
      File = GrasshopperDocument.FilePath
      Folder = IO.Path.GetDirectoryName(GrasshopperDocument.FilePath) & IO.Path.DirectorySeparatorChar
    Catch
    End Try
# ---------- end vb ----------
panel_7 = Panel(vb.Folder)
concat = Concatenate(FragmentA=panel_7, FragmentB="DynamicRelaxationComponent.py")
file = ReadFile(File=concat, PerLineParse=False)

concat_2 = Concatenate(FragmentA=panel_7, FragmentB="DynamicRelaxationMaterialsComponent.py")
file_2 = ReadFile(File=concat_2, PerLineParse=False)
python_2 = PythonScript(Code=file_2, PreSpecified=list_2, UserDefined=merge_9)  # -> Out, A
merge_tolerance = Slider(1, range=1..10)
run = BooleanToggle(False)
reset = BooleanToggle(False)
adjust_forces = BooleanToggle(False)
step_size = Slider(500, range=1..50000)
timer = Timer(TimerInterval=2, Target=dynamic_relaxation_engine)

# ----
# Pin Joints
# Rail Constrained Pin Joints
# Plane Constrained Pin Joints
deplane = DeconstructPlane(Plane=pln)  # -> Origin, XAxis, YAxis, ZAxis
deplane_2 = DeconstructPlane(Plane=pln_2)  # -> Origin, XAxis, YAxis, ZAxis
merge_10 = Merge(Data1=crv_4, Data2=pt_8)
merge_11 = Merge(Data1=crv_3, Data2=pt_7)
path_mapper_17 = PathMapper(merge_10, source="{0}", target="{0}")
path_mapper_18 = PathMapper(merge_11, source="{0}", target="{1}")
merge_12 = Merge(Data1=path_mapper_17, Data2=path_mapper_18)

pt_11 = Point(deplane_2.ZAxis)
pt_12 = Point(deplane.ZAxis)

merge_13 = Merge(Data1=pt_11, Data2=pt_4)
merge_14 = Merge(Data1=pt_12, Data2=pt_3)
path_mapper_19 = PathMapper(merge_13, source="{0}", target="{0}")
path_mapper_20 = PathMapper(merge_14, source="{0}", target="{1}")
merge_15 = Merge(Data1=path_mapper_19, Data2=path_mapper_20)

panel_8 = Panel(merge_12)
dynamic_relaxation_engine = PythonScript(
    Code=file,
    Beams=merge_5,
    Trusses=merge_7,
    Cables=merge_6,
    Loads=merge_2,
    PinnedPoints=pt_2,
    LineConstrainedPoints=merge_8,
    RailConstrainedPoints=merge_12,
    PlaneConstrainedPoints=merge_15,
    Materials=python_2.A,
    Run=run,
    Reset=reset,
    Step=step_size,
    Adjust=adjust_forces,
    Epsilon=merge_tolerance)  # -> Out, BeamsOUT, TrussesOUT, CablesOUT, StressOUT, StressMinMax, LoadsOUT, LoadsDirOUT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
panel_9 = Panel(dynamic_relaxation_engine.Out)
panel_10 = Panel(dynamic_relaxation_engine.StepCounter)
pt_13 = Point(dynamic_relaxation_engine.LoadsOUT)
crv_11 = Curve(dynamic_relaxation_engine.TrussesOUT)
pt_14 = Point(dynamic_relaxation_engine.Particles)
vdis_3 = VectorDisplay(Anchor=pt_13, Vector=dynamic_relaxation_engine.LoadsDirOUT)
item_3 = ListItem(List=dynamic_relaxation_engine.StressMinMax, Index=1, Wrap=True)
item_4 = ListItem(List=dynamic_relaxation_engine.StressMinMax, Index=0, Wrap=True)
gradient = Gradient(
    LowerLimit=item_4,
    UpperLimit=item_3,
    Parameter=dynamic_relaxation_engine.StressOUT,
    stops=[0: RGB(0, 0, 255), 0.494: RGB(255, 128, 0), 1: RGB(255, 0, 0)])
explode_3 = Explode(Curve=dynamic_relaxation_engine.BeamsOUT, Recursive=True)  # -> Segments, Vertices
crv_12 = Curve(dynamic_relaxation_engine.CablesOUT)
pt_15 = Point(dynamic_relaxation_engine.FixedPointsOUT)
crv_13 = Curve(dynamic_relaxation_engine.BeamsOUT)
preview = CustomPreview(Geometry=explode_3.Segments, Shader=gradient)

# ==== cluster Cluster
line = LineSDL(Start=Point(0, 0, 0), Direction=Vector(1, 0, 0), Length=1)
line_2 = LineSDL(Start=Point(0, 0, 0), Direction=Vector(0, 1, 0), Length=1)
line_3 = LineSDL(Start=Point(0, 0, 0), Direction=Vector(0, 0, 1), Length=1)
line_4 = LineSDL(Start=Point(0, 0, 0), Direction=Vector(0, 0, 1), Length=1)
A = ClusterInput()
X = ClusterInput()
vrot = Rotate(Vector=line_4, Axis=line, Angle=degrees(A))
vec = VectorXYZ(XComponent=X, YComponent=0, ZComponent=0)  # -> Vector, Length
A_2 = ClusterInput()
A_3 = ClusterInput()
vrot_2 = Rotate(Vector=vrot, Axis=line_2, Angle=degrees(A_2))
vrot_3 = Rotate(Vector=vrot_2, Axis=line_3, Angle=degrees(A_3))
G = ClusterInput()
rev = Reverse(Vector=vrot_3)
V = ClusterOutput(vrot_3)
d3 = ClusterInput()
move = Move(Geometry=G, Motion=vrot_3)  # -> Geometry, Transform
V_2 = ClusterOutput(rev)
merge = Merge(Data1=rev, Data2=vec.Vector, Data3=d3)
G_2 = ClusterOutput(move.Geometry)
R = ClusterOutput(merge)
