# Grasshopper definition DynamicRelaxation_simplearc_tripod.gh (Grasshopper 0.9.70)
# plug-ins: Python Interpreter

pt = Point([Point(10, 3, 0), Point(14, 0, 0), Point(10, -3, 0)])
pt_2 = Point([Point(-10, 0, 0), Point(0, 0, 10)])
pt_3 = Point(Point(10, 0, 5))
item = ListItem(List=pt, Index=0, Wrap=True)
item_2 = ListItem(List=pt, Index=1, Wrap=True)
item_3 = ListItem(List=pt, Index=2, Wrap=True)
item_4 = ListItem(List=pt_2, Index=1, Wrap=True)
item_5 = ListItem(List=pt_2, Index=0, Wrap=True)
arc = Arc3Pt(PointA=item_5, PointB=item_4, PointC=pt_3)  # -> Arc, Plane, Radius
pline = PolyLine(Vertices=[item, pt_3], Closed=False)
pline_2 = PolyLine(Vertices=[item_2, pt_3], Closed=False)
pline_3 = PolyLine(Vertices=[item_3, pt_3], Closed=False)
divide = DivideCurve(Curve=arc.Arc, Count=Slider(8, range=0..10), Kinks=False)  # -> Points, Tangents, Parameters
flatten = FlattenTree(Tree=[pline, pline_2, pline_3], Path="{0}")
pline_4 = PolyLine(Vertices=divide.Points, Closed=False)
flatten_2 = FlattenTree(Tree=pline_4, Path="{0}")
loads = Loads_2(pt=<geometry referenced from the Rhino model>)
panel = Panel(loads)

# ---- group: Load DR Python Modules
drcode = PythonScript()  # -> Out, DRC, DRMC
# ---------- drcode: Python ----------
"""
Loads the Dynamic Relaxation Python modules. The module .py 
files should be placed in the default Grasshopper library folder:

C:\Users\userName\AppData\Roaming\Grasshopper\Libraries

Or via the Grasshopper GUI:

File -> Special Folders -> Components Folder

Author: Anders Holden Deleuran (CITA)
Contact: adel@kadk.dk

    Returns:
        DRC: DynamicRelaxationComponent.
        DRMC: DynamicRelaxationMaterialsComponent
"""

import sys
import os

def addGHComponentsFolderToPath():
    
    """ Adds the default Grasshopper components folder to the Python path
    enabling you to place modules in this folder without asking the user
    to fiddle with the paths via the editPythonScriptEditor.
    
    Alternatively we could use:    
    C:\Users\userName\AppData\Roaming\McNeel\Rhinoceros\5.0\scripts    
    Which is already in the RhinoPython path """
    
    # Get username and build path
    userName = os.environ["USERNAME"]
    ghPathGeneric = "C:\Users\userName\AppData\Roaming\Grasshopper\Libraries"
    ghPathUser = ghPathGeneric.replace("userName",userName)
    
    # Add Grasshopper components folder path to sys
    if ghPathUser not in sys.path:
        sys.path.append(ghPathUser)
        
    return ghPathUser

# Add the default Grasshopper components folder to the Python path 
ghFolder = addGHComponentsFolderToPath()

# Build path to and read DynamicRelaxationComponent code
drcPath = ghFolder + "\DynamicRelaxationComponent.py"
drcFile = open(drcPath,"r")
drcStr = drcFile.read()

# Build path to and read DynamicRelaxationMaterialsComponent code
drmcPath = ghFolder + "\DynamicRelaxationMaterialsComponent.py"
drmcFile = open(drmcPath,"r")
drmcStr = drmcFile.read()

# Output Python code to GH
DRC = drcStr
DRMC = drmcStr
# ---------- end drcode ----------

# ---- group: Configure DR Inputs
loads_2 = Loads(loadlocation=<geometry referenced from the Rhino model>)
restraints = Restraints(pinnedpoints=[item_5, pt])  # -> pinnedpoints_3, lineconstrainedpoints, railconstrainedpoints, planeconstrainedpoints
elements = Elements(beams00=flatten_2, trusses01=flatten)  # -> beams_2, trusses_2, cables_2
materials = Materials(drmc=drcode.DRMC)

# ----
panel_2 = Panel(loads_2)
reset = BooleanToggle(False)

# ---- group: I Calculator
list = ValueList({"Circular Solid": 1, "Circular Tube": 2, "Rectangular Solid": 3}, selected="Circular Tube")
icalculator = PythonScript(
    type=list,
    innerRadius=Slider(2, range=0..10),
    outerRadius=Slider(3, range=0..10),
    width=Slider(0.25, range=0..10),
    height=Slider(0.25, range=0..10))  # -> out, I
# ---------- icalculator: Python ----------
""" Area moments of inertia calculator """

import math

def circular(r):
    return (math.pi/4)*math.pow(r,4)
    
def circularTube(r1, r2):
    print math.pow(r2,4) - math.pow(r1, 4)
    return (math.pi/4)*(math.pow(r2,4) - math.pow(r1, 4))

def rectangle(w,h):
    return (w*math.pow(h,3))/12

if type == 1:
    I = circular(outerRadius)
elif type == 2:
    I = circularTube(innerRadius, outerRadius)
elif type == 3:
    I = rectangle(width, height)
# ---------- end icalculator ----------
panel_3 = Panel(icalculator.I)

# ---- group: Trigger Example
newtons = Slider(10, range=0..25000)
newtons_2 = Slider(9935.225, range=0..25000)
trigger = Slider(100, range=0..1000)
python = PythonScript(trigger=trigger, before=newtons, after=newtons_2)  # -> out, a
# ---------- python: Python ----------
if x > trigger:
    a = after
else:
    a = before
# ---------- end python ----------

# ---- group: DR Engine Controls
step_size = Slider(440, range=200..5000)
adjust_forces = BooleanToggle(False)
run = BooleanToggle(False)

# ---- group: DR Engine
dynamic_relaxation_engine = PythonScript(
    Code=drcode.DRC,
    Beams=elements.beams_2,
    Trusses=elements.trusses_2,
    Cables=elements.cables_2,
    Loads=loads,
    PinnedPoints=restraints.pinnedpoints_3,
    LineConstrainedPoints=restraints.lineconstrainedpoints,
    RailConstrainedPoints=restraints.railconstrainedpoints,
    PlaneConstrainedPoints=restraints.planeconstrainedpoints,
    Materials=materials,
    Run=run,
    Reset=reset,
    Step=step_size,
    Adjust=adjust_forces,
    Epsilon=0.001)  # -> Out, BeamsOUT, TrussesOUT, CablesOUT, BeamStressOUT, TrussStressOUT, CableStressOUT, StressBeamMinMax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
timer = Timer(TimerInterval=2, Target=dynamic_relaxation_engine)

# ---- group: DR Engine Controls (continued)
stepcounter = Panel(dynamic_relaxation_engine.StepCounter)

# ---- group: Visualize DR Outputs
crv = Curve(dynamic_relaxation_engine.BeamsOUT)
crv_2 = Curve(dynamic_relaxation_engine.TrussesOUT)
crv_3 = Curve(dynamic_relaxation_engine.CablesOUT)
pt_4 = Point(dynamic_relaxation_engine.LoadsOUT)
pt_5 = Point(dynamic_relaxation_engine.FixedPointsOUT)
pt_6 = Point(dynamic_relaxation_engine.Particles)
vdis = VectorDisplay(Anchor=pt_4, Vector=dynamic_relaxation_engine.LoadsDirOUT)
dispatch = Dispatch(List=dynamic_relaxation_engine.StressBeamMinMax, DispatchPattern=[True, False])  # -> ListA, ListB
dispatch_2 = Dispatch(List=dynamic_relaxation_engine.StressTrussMinMax, DispatchPattern=[True, False])  # -> ListA, ListB
dispatch_3 = Dispatch(List=dynamic_relaxation_engine.StressCableMinMax, DispatchPattern=[True, False])  # -> ListA, ListB
gradient = Gradient(
    LowerLimit=dispatch.ListA,
    UpperLimit=dispatch.ListB,
    Parameter=dynamic_relaxation_engine.BeamStressOUT,
    stops=[0: RGB(0, 0, 255), 0.494: RGB(255, 128, 0), 1: RGB(255, 0, 0)])
gradient_2 = Gradient(
    LowerLimit=dispatch_2.ListA,
    UpperLimit=dispatch_2.ListB,
    Parameter=dynamic_relaxation_engine.TrussStressOUT,
    stops=[0: RGB(243, 57, 0), 0.1: RGB(236, 27, 60), 0.2: RGB(210, 0, 118), 0.3: RGB(103, 0, 120), 0.4: RGB(39, 72, 161), 0.5: RGB(1, 192, 229), 0.6: RGB(18, 178, 90), 0.7: RGB(79, 186, 8), 0.8: RGB(220, 237, 32), 0.9: RGB(247, 159, 20), 1: RGB(243, 57, 0)])
gradient_3 = Gradient(
    LowerLimit=dispatch_3.ListA,
    UpperLimit=dispatch_3.ListB,
    Parameter=dynamic_relaxation_engine.CableStressOUT,
    stops=[0: RGB(234, 38, 0), 0.25: RGB(234, 126, 0), 0.5: RGB(254, 244, 84), 0.75: RGB(173, 203, 249), 1: RGB(75, 107, 169)])
explode = Explode(Curve=crv, Recursive=True)  # -> Segments, Vertices
explode_2 = Explode(Curve=crv_2, Recursive=True)  # -> Segments, Vertices
explode_3 = Explode(Curve=crv_3, Recursive=True)  # -> Segments, Vertices
preview = CustomPreview(Geometry=explode.Segments, Shader=gradient)
preview_2 = CustomPreview(Geometry=explode_2.Segments, Shader=gradient_2)
preview_3 = CustomPreview(Geometry=explode_3.Segments, Shader=gradient_3)

# ----
panel_4 = Panel(dynamic_relaxation_engine.Out)

# ==== cluster Elements: Elements can be beam, truss or cable elements.
# Elements: Elements can be beam, truss or cable elements.
# 
# # TODO: Rewrite Below
# 
# To make a new element collection, copy paste the naming panel, the curve collection and the path mapper (everything before the merge component). Increase the target value of the path mapper to the next unique integer.  Select new curves and name as appropriate.
beams00 = ClusterInput()
trusses01 = ClusterInput()

# ---- group: Beams
beams00_2 = Curve(beams00)
beams01 = Curve([<curve referenced from the Rhino model> x7])
beams = PythonScript(GFRP_D2=beams00_2)  # -> Beams; inputs GFRP_D2: tree of Curve, STEEL_D2: tree
# ---------- beams: Python ----------
"""
Iterates the component inputs parameters, gets the first branch
in the input datatrees (remember to set the typehint to "Tree Access"
when adding new parameter inputs), then inserts the name of the parameter
at the start of the branch. Outputs a GH datatree with lists for all inputs.
-
Author: Anders Holden Deleuran (CITA)
Contact: adel@kadk.dk
"""

import Grasshopper as gh

def listToGhDataTree(list):
    
    """Returns a GH DataTree containing the elements of a Python iterable"""
    
    # Make empty GH data tree
    dataTree = gh.DataTree[object]()
    
    # Add the data from the list to the datatree
    for i, v in enumerate(list):
        for d in v:
            dataTree.Add(d,gh.Kernel.Data.GH_Path(i))
            
    return dataTree

def iterateInputParameters():
    
    """Iterate component input parameters, read names and data in first branch"""
    
    # Output list
    paramData = []
    
    # Get input param count
    paramCount = ghenv.Component.Params.Input.Count
    
    # Iterate the input parameters
    for i in range(paramCount):
        
        # Get the param name
        name = ghenv.Component.Params.Input[i].NickName
        
        # Access the Gh_structure (which is kinda like a datatree)
        ghStruc = ghenv.Component.Params.Input[i].VolatileData
        dataCount = ghenv.Component.Params.Input[i].VolatileDataCount
        
        if dataCount:
            
            # Get the data in the first path in the Gh_structure
            firstPath = ghStruc.Path[0]
            gooData = list(ghStruc.Branch[firstPath])
            
            # Check for nulls and remove
            gooData = [item for item in gooData if item != None]
            
            # Convert the goo data in this path into something useful in Python
            actualData = [item.Value for item in gooData]
            
            if actualData:
                
                # Add name to actual data list
                actualData.Insert(0,name)
                
                # Append data to return list
                paramData.append(actualData)
                
    return paramData

# Call functions and output to GH
paramsNestedList = iterateInputParameters()
paramsGHTree = listToGhDataTree(paramsNestedList)
Beams = paramsGHTree
# ---------- end beams ----------
beams_2 = ClusterOutput(beams)

# ---- group: Trusses
trusses00 = Curve([<curve referenced from the Rhino model> x7])
trusses01_2 = Curve(trusses01)
trusses02 = Curve([<curve referenced from the Rhino model> x7])
trusses = PythonScript(STEEL_D2=trusses01_2)  # -> Trusses; inputs MATERIAL_THREE: tree of Curve, STEEL_D2: tree, MATERIAL_FOUR: tree
# ---------- trusses: Python ----------
"""
Iterates the component inputs parameters, gets the first branch
in the input datatrees (remember to set the typehint to "Tree Access"
when adding new parameter inputs), then inserts the name of the parameter
at the start of the branch. Outputs a GH datatree with lists for all inputs.
-
Author: Anders Holden Deleuran (CITA)
Contact: adel@kadk.dk
"""

import Grasshopper as gh

def listToGhDataTree(list):
    
    """Returns a GH DataTree containing the elements of a Python iterable"""
    
    # Make empty GH data tree
    dataTree = gh.DataTree[object]()
    
    # Add the data from the list to the datatree
    for i, v in enumerate(list):
        for d in v:
            dataTree.Add(d,gh.Kernel.Data.GH_Path(i))
            
    return dataTree

def iterateInputParameters():
    
    """Iterate component input parameters, read names and data in first branch"""
    
    # Output list
    paramData = []
    
    # Get input param count
    paramCount = ghenv.Component.Params.Input.Count
    
    # Iterate the input parameters
    for i in range(paramCount):
        
        # Get the param name
        name = ghenv.Component.Params.Input[i].NickName
        
        # Access the Gh_structure (which is kinda like a datatree)
        ghStruc = ghenv.Component.Params.Input[i].VolatileData
        dataCount = ghenv.Component.Params.Input[i].VolatileDataCount
        
        if dataCount:
            
            # Get the data in the first path in the Gh_structure
            firstPath = ghStruc.Path[0]
            gooData = list(ghStruc.Branch[firstPath])
            
            # Check for nulls and remove
            gooData = [item for item in gooData if item != None]
            
            # Convert the goo data in this path into something useful in Python
            actualData = [item.Value for item in gooData]
            
            if actualData:
                
                # Add name to actual data list
                actualData.Insert(0,name)
                
                # Append data to return list
                paramData.append(actualData)
                
    return paramData

# Call functions and output to GH
paramsNestedList = iterateInputParameters()
paramsGHTree = listToGhDataTree(paramsNestedList)
Trusses = paramsGHTree
# ---------- end trusses ----------
trusses_2 = ClusterOutput(trusses)

# ---- group: Cables
cables00 = Curve([<curve referenced from the Rhino model> x373])
cables01 = Curve([<curve referenced from the Rhino model> x7])
cables02 = Curve([<curve referenced from the Rhino model> x7])
cables = PythonScript(MATERIAL_THREE=cables00)  # -> Cables; inputs MATERIAL_THREE: tree of Curve, MATERIAL_THREE_2: tree
# ---------- cables: Python ----------
"""
Iterates the component inputs parameters, gets the first branch
in the input datatrees (remember to set the typehint to "Tree Access"
when adding new parameter inputs), then inserts the name of the parameter
at the start of the branch. Outputs a GH datatree with lists for all inputs.
-
Author: Anders Holden Deleuran (CITA)
Contact: adel@kadk.dk
"""

import Grasshopper as gh

def listToGhDataTree(list):
    
    """Returns a GH DataTree containing the elements of a Python iterable"""
    
    # Make empty GH data tree
    dataTree = gh.DataTree[object]()
    
    # Add the data from the list to the datatree
    for i, v in enumerate(list):
        for d in v:
            dataTree.Add(d,gh.Kernel.Data.GH_Path(i))
            
    return dataTree

def iterateInputParameters():
    
    """Iterate component input parameters, read names and data in first branch"""
    
    # Output list
    paramData = []
    
    # Get input param count
    paramCount = ghenv.Component.Params.Input.Count
    
    # Iterate the input parameters
    for i in range(paramCount):
        
        # Get the param name
        name = ghenv.Component.Params.Input[i].NickName
        
        # Access the Gh_structure (which is kinda like a datatree)
        ghStruc = ghenv.Component.Params.Input[i].VolatileData
        dataCount = ghenv.Component.Params.Input[i].VolatileDataCount
        
        if dataCount:
            
            # Get the data in the first path in the Gh_structure
            firstPath = ghStruc.Path[0]
            gooData = list(ghStruc.Branch[firstPath])
            
            # Check for nulls and remove
            gooData = [item for item in gooData if item != None]
            
            # Convert the goo data in this path into something useful in Python
            actualData = [item.Value for item in gooData]
            
            if actualData:
                
                # Add name to actual data list
                actualData.Insert(0,name)
                
                # Append data to return list
                paramData.append(actualData)
                
    return paramData

# Call functions and output to GH
paramsNestedList = iterateInputParameters()
paramsGHTree = listToGhDataTree(paramsNestedList)
Cables = paramsGHTree
# ---------- end cables ----------
cables_2 = ClusterOutput(cables)

# ==== cluster Loads: Loads can be single points or point collections. Set the force in Newtons, and the direction of the force using X, Y and Z axis rotations.
loadlocation = ClusterInput()

# ----
# Loads: Loads can be single points or point collections. Set the force in Newtons, and the direction of the force using X, Y and Z axis rotations.
x_axis_rotation = Slider(0, range=0..360)
y_axis_rotation = Slider(0, range=0..360)
z_axis_rotation = Slider(0, range=0..360)
newtons = Slider(500, range=0..25000)
loadlocation_2 = Point(loadlocation)
load = PythonScript(
    LoadLocation=loadlocation_2,
    XAxisRotation=x_axis_rotation,
    YAxisRotation=y_axis_rotation,
    ZAxisRotation=z_axis_rotation,
    Newtons=newtons)  # -> Anchor, Direction, Load; inputs LoadLocation: Point3d
# ---------- load: Python ----------
"""
Author: Anders Holden Deleuran (CITA)
Contact: adel@kadk.dk
"""

import Rhino as rc
import math

if LoadLocation:
    
    # Vectors
    direction = rc.Geometry.Vector3d(0,0,-1)
    worldX = rc.Geometry.Vector3d(1,0,0)
    worldY = rc.Geometry.Vector3d(0,1,0)
    worldZ = rc.Geometry.Vector3d(0,0,1)
    
    # Rotate direction around world axis
    direction.Rotate(math.radians(XAxisRotation),worldX)
    direction.Rotate(math.radians(YAxisRotation),worldY)
    direction.Rotate(math.radians(ZAxisRotation),worldZ)
    
    # Make magnitude vector
    magnitude = rc.Geometry.Vector3d(Newtons,0,0)
    
    # Output to GH
    Direction = direction * (Newtons/200)
    Anchor = LoadLocation - Direction
    Load = (direction,magnitude,LoadLocation)
# ---------- end load ----------
vdis = VectorDisplay(Anchor=load.Anchor, Vector=load.Direction)

entwine = Entwine(Branch00=load.Load)  # -> simplify(Result)
loads = ClusterOutput(entwine)

# ==== cluster Materials: Materials & sections can be chosen from the list of prespecified materials or user defined. Add new material in the same manner as described above. All materials have by default 5 parameters. However, these are not all used by each material. For example, membrane materials do not take a value for second moment of inertia. In these cases, the set value is ignored.

youngs_modulus_of_elasticity_e = Slider(16708.921, range=0..50000)
second_moment_of_inertia_i = Slider(0.81, range=0..1000)
neutral_axis_distance = Slider(0.25, range=0..10)
sectional_area_a = Slider(0.55, range=0..200)
coefficient = Slider(0.9, range=0..1)
materialparameters = Number([youngs_modulus_of_elasticity_e, sectional_area_a, second_moment_of_inertia_i, coefficient, neutral_axis_distance])

# ----
# Materials & Sections: Materials & sections can be chosen from the list of prespecified materials or user defined.
# 
# Add new material in the same manner as described above.
# 
# All materials have by default 5 parameters.  However, these are not all used by each material. For example, membrane materials do not take a value for second moment of inertia.  In these cases, the set value is ignored.
youngs_modulus_of_elasticity_e_2 = Slider(3500, range=0..50000)
second_moment_of_inertia_i_2 = Slider(0.785, range=0..1000)
neutral_axis_distance_2 = Slider(1, range=0..10)
sectional_area_a_2 = Slider(3.142, range=0..200)
coefficient_2 = Slider(1, range=0..1)
materialparameters_2 = Number([youngs_modulus_of_elasticity_e_2, sectional_area_a_2, second_moment_of_inertia_i_2, coefficient_2, neutral_axis_distance_2])

youngs_modulus_of_elasticity_e_3 = Slider(1584.164, range=0..50000)
second_moment_of_inertia_i_3 = Slider(0.81, range=0..1000)
neutral_axis_distance_3 = Slider(0.375, range=0..10)
sectional_area_a_3 = Slider(0.25, range=0..200)
coefficient_3 = Slider(0.95, range=0..1)
materialparameters_3 = Number([youngs_modulus_of_elasticity_e_3, sectional_area_a_3, second_moment_of_inertia_i_3, coefficient_3, neutral_axis_distance_3])

youngs_modulus_of_elasticity_e_4 = Slider(3500, range=0..50000)
second_moment_of_inertia_i_4 = Slider(0.81, range=0..1000)
neutral_axis_distance_4 = Slider(0.25, range=0..10)
sectional_area_a_4 = Slider(0.55, range=0..200)
coefficient_4 = Slider(0.95, range=0..1)
materialparameters_4 = Number([youngs_modulus_of_elasticity_e_4, sectional_area_a_4, second_moment_of_inertia_i_4, coefficient_4, neutral_axis_distance_4])

pre_specified = ValueList({"GFRP_D2": 0, "GFRP_D3": 1, "STEEL_D2": 2, "RATTAN_D6": 3, "RATTAN_D10": 4, "WOOD_2*20": 5, "MEMBRANE": 6, "PVC_D2": 7}, selected=["GFRP_D2", "GFRP_D3", "STEEL_D2", "RATTAN_D6", "RATTAN_D10", "WOOD_2*20", "MEMBRANE", "PVC_D2"])
userdefined = PythonScript(
    MATERIAL_ONE=materialparameters_2,
    MATERIAL_TWO=materialparameters_3,
    MATERIAL_THREE=materialparameters_4,
    MATERIAL_FOUR=materialparameters)  # -> UserDefined; inputs MATERIAL_ONE: tree, MATERIAL_TWO: tree, MATERIAL_THREE: tree, MATERIAL_FOUR: tree
# ---------- userdefined: Python ----------
"""
Iterates the component inputs parameters, gets the first branch
in the input datatrees (remember to set the typehint to "Tree Access"
when adding new parameter inputs), then inserts the name of the parameter
at the start of the branch. Outputs a GH datatree with lists for all inputs.
-
Author: Anders Holden Deleuran (CITA)
Contact: adel@kadk.dk
"""


import Grasshopper as gh

def listToGhDataTree(list):
    
    """Returns a GH DataTree containing the elements of a Python iterable"""
    
    # Make empty GH data tree
    dataTree = gh.DataTree[object]()
    
    # Add the data from the list to the datatree
    for i, v in enumerate(list):
        for d in v:
            dataTree.Add(d,gh.Kernel.Data.GH_Path(i))
            
    return dataTree

def iterateInputParameters():
    
    """Iterate component input parameters, read names and data in first branch"""
    
    # Output list
    paramData = []
    
    # Get input param count
    paramCount = ghenv.Component.Params.Input.Count
    
    # Iterate the input parameters
    for i in range(paramCount):
        
        # Get the param name
        name = ghenv.Component.Params.Input[i].NickName
        
        # Access the Gh_structure (which is kinda like a datatree)
        ghStruc = ghenv.Component.Params.Input[i].VolatileData
        dataCount = ghenv.Component.Params.Input[i].VolatileDataCount
        
        if dataCount:
            
            # Get the data in the first path in the Gh_structure
            firstPath = ghStruc.Path[0]
            gooData = list(ghStruc.Branch[firstPath])
            
            # Check for nulls and remove
            gooData = [item for item in gooData if item != None]
            
            # Convert the goo data in this path into something useful in Python
            actualData = [item.Value for item in gooData]
            
            if actualData:
                
                # Add name to actual data list
                actualData.Insert(0,name)
                
                # Append data to return list
                paramData.append(actualData)
                
    return paramData

# Call functions and output to GH
paramsNestedList = iterateInputParameters()
paramsGHTree = listToGhDataTree(paramsNestedList)
UserDefined = paramsGHTree
# ---------- end userdefined ----------
drmc = ClusterInput()  # The DRMC Python component code
materials = PythonScript(Code=drmc, PreSpecified=pre_specified, UserDefined=userdefined)  # -> Out, A
materials_2 = ClusterOutput(materials.A)

# ==== cluster Restraints
pinnedpoints = ClusterInput()
xy = XYPlane(Origin=Point(0, 0, 0))

# ---- group: Line Constrained Pin Joints
crv = Curve(<curve referenced from the Rhino model>)
end = EndPoints(Curve=crv)  # -> Start, End
vec2pt = Vector2Pt(PointA=end.Start, PointB=end.End, Unitize=False)  # -> Vector, Length
unit = UnitVector(Vector=vec2pt.Vector)
pt = Point(<point referenced from the Rhino model>)
vec = Vector(unit)
pt_2 = Point()
vec_2 = Vector()
merge = Merge(Data1=vec, Data2=pt)
merge_2 = Merge(Data1=vec_2, Data2=pt_2)
path_mapper = PathMapper(merge, source="{0}", target="{0}")
path_mapper_2 = PathMapper(merge_2, source="{0}", target="{1}")
merge_3 = Merge(Data1=path_mapper, Data2=path_mapper_2)

# ---- group: Pin Joints
pinnedpoints_2 = Point(pinnedpoints)
pinnedpoints_3 = ClusterOutput(pinnedpoints_2)

# ---- group: Rail Constrained Pin Joints
rail = Curve()
pins = Point()
rail_2 = Curve()
pins_2 = Point()
railpins = PythonScript(Rail=rail, Pins=pins)  # -> RailPins; inputs Rail: Curve, Pins: list of Point3d
# ---------- railpins: Python ----------
"""
Rail Constrained Pin Joints

    Args:
        Rail: The rail (curve) to restrain the pin joints (points)to.
        Pins: The pin joints (points) to constrain.
    Returns:
        RailPins: The resulting constraint description.
"""

import Rhino as rc

if Rail and Pins and Pins[0]:
    
    # Add this point to the pins list
    Pins.Insert(0,Rail)
    
    # Output to GH
    RailPins = Pins
# ---------- end railpins ----------
railpins_2 = PythonScript(Rail=rail_2, Pins=pins_2)  # -> RailPins; inputs Rail: Curve, Pins: list of Point3d; same code as railpins
entwine = Entwine(Branch00=railpins, Branch01=railpins_2)  # -> simplify(Result)
railconstrainedpoints = ClusterOutput(entwine)

# ---- group: Plane Constrained Pin Joints
plane = Plane(xy)
pins_3 = Point()
plane_2 = Plane()
pins_4 = Point()
planepin = PythonScript(Plane=plane, Pins=pins_3)  # -> PlanePins; inputs Plane: Plane, Pins: list of Point3d
# ---------- planepin: Python ----------
"""
Plane Constrained Pin Joints

    Args:
        Plane: The plane to restrain the pin joints (points)to.
        Pins: The pin joints (points) to constrain.
    Returns:
        PlanePins: The resulting constraint description.
"""

import Rhino as rc

if Plane and Pins and Pins[0]:
    
    # Get the plane z-axis as point3D
    planeZPt = rc.Geometry.Point3d(Plane.ZAxis)
    
    # Add this point to the pins list
    Pins.Insert(0,planeZPt)
    
    # Output to GH
    PlanePins = Pins
# ---------- end planepin ----------
planepin_2 = PythonScript(Plane=plane_2, Pins=pins_4)  # -> PlanePins; inputs Plane: Plane, Pins: list of Point3d; same code as planepin
entwine_2 = Entwine(Branch00=planepin)  # -> simplify(Result)
planeconstrainedpoints = ClusterOutput(entwine_2)

# ----
lineconstrainedpoints = ClusterOutput(merge_3)

# ==== cluster Loads_2: Loads can be single points or point collections. New loads are added in the same manner as described above. Remember to increase the target integer in the path mapper component to the next unique integer. Set the force in Newtons, and the direction of the force using X, Y and Z axis rotations.
# Loads: Loads can be single points or point collections.
# 
# New loads are added in the same manner as described above. Remember to increase the target integer in the path mapper component to the next unique integer.
# 
# Set the force in Newtons, and the direction of the force using X, Y and Z axis rotations.
pt = ClusterInput()
# LOADS
x_axis_rotation = Slider(0, range=0..360)
y_axis_rotation = Slider(0, range=0..360)
newtons = Slider(200, range=0..25000)
pt_2 = Point(pt)
z_axis_rotation = Slider(0, range=0..360)
newtons_2 = Slider(20, range=0..25000)
pt_3 = Point([<point referenced from the Rhino model> x5])
# LOADS
x_axis_rotation_2 = Slider(0, range=0..360)
y_axis_rotation_2 = Slider(0, range=0..360)
z_axis_rotation_2 = Slider(0, range=0..360)
cluster = Cluster(A=x_axis_rotation, G=pt_2, A_3=z_axis_rotation, A_2=y_axis_rotation, X=newtons, d3=pt_2)  # -> V, G_2, V_2, R
cluster_2 = Cluster(A=x_axis_rotation_2, G=pt_3, A_3=z_axis_rotation_2, A_2=y_axis_rotation_2, X=newtons_2, d3=pt_3)  # -> V, G_2, V_2, R
line = LineSDL(Start=pt_2, Direction=cluster.V, Length=expr("abs(x)/500", newtons))
line_2 = LineSDL(Start=pt_3, Direction=cluster_2.V, Length=expr("abs(x)/500", newtons_2))
vdis = VectorDisplay(Anchor=cluster.G_2, Vector=cluster.V_2)
vdis_2 = VectorDisplay(Anchor=cluster_2.G_2, Vector=cluster_2.V_2)
entwine = Entwine(Branch00=cluster.R, Branch01=cluster_2.R)  # -> simplify(Result)
loads = ClusterOutput(entwine)

# ==== cluster Cluster
line = LineSDL(Start=Point(0, 0, 0), Direction=Vector(1, 0, 0), Length=1)
line_2 = LineSDL(Start=Point(0, 0, 0), Direction=Vector(0, 1, 0), Length=1)
line_3 = LineSDL(Start=Point(0, 0, 0), Direction=Vector(0, 0, 1), Length=1)
line_4 = LineSDL(Start=Point(0, 0, 0), Direction=Vector(0, 0, 1), Length=1)
A = ClusterInput()
X = ClusterInput()
vrot = Rotate(Vector=line_4, Axis=line, Angle=degrees(A))
vec = VectorXYZ(XComponent=X, YComponent=0, ZComponent=0)  # -> Vector, Length
A_2 = ClusterInput()
A_3 = ClusterInput()
vrot_2 = Rotate(Vector=vrot, Axis=line_2, Angle=degrees(A_2))
vrot_3 = Rotate(Vector=vrot_2, Axis=line_3, Angle=degrees(A_3))
G = ClusterInput()
rev = Reverse(Vector=vrot_3)
V = ClusterOutput(vrot_3)
d3 = ClusterInput()
move = Move(Geometry=G, Motion=vrot_3)  # -> Geometry, Transform
V_2 = ClusterOutput(rev)
merge = Merge(Data1=rev, Data2=vec.Vector, Data3=d3)
G_2 = ClusterOutput(move.Geometry)
R = ClusterOutput(merge)
