# Grasshopper definition DynamicRelaxation.gh (Grasshopper 0.9.64)
# plug-ins: Python Interpreter

list = ValueList({"Circular Solid": 1, "Circular Tube": 2, "Rectangular Solid": 3}, selected="Circular Tube")
trigger = Slider(100, range=0..1000)
newtons = Slider(10, range=0..25000)
newtons_2 = Slider(9935.225, range=0..25000)
python = PythonScript(trigger=trigger, before=newtons, after=newtons_2)  # -> out, a
# ---------- python: Python ----------
if x > trigger:
    a = after
else:
    a = before
# ---------- end python ----------
area_moments_of_inertia_calculator = PythonScript(
    type=list,
    innerRadius=Slider(2, range=0..10),
    outerRadius=Slider(3, range=0..10),
    width=Slider(0.25, range=0..10),
    height=Slider(0.25, range=0..10))  # -> out, I
# ---------- area_moments_of_inertia_calculator: Python ----------
import math

def circular(r):
    return (math.pi/4)*math.pow(r,4)
    
def circularTube(r1, r2):
    print math.pow(r2,4) - math.pow(r1, 4)
    return (math.pi/4)*(math.pow(r2,4) - math.pow(r1, 4))

def rectangle(w,h):
    return (w*math.pow(h,3))/12

if type == 1:
    I = circular(outerRadius)
elif type == 2:
    I = circularTube(innerRadius, outerRadius)
elif type == 3:
    I = rectangle(width, height)
# ---------- end area_moments_of_inertia_calculator ----------
crv = Curve(<curve referenced from the Rhino model>)
panel = Panel(area_moments_of_inertia_calculator.I)
end = EndPoints(Curve=crv)  # -> Start, End
vec2pt = Vector2Pt(PointA=end.Start, PointB=end.End, Unitize=False)  # -> Vector, Length
unit = UnitVector(Vector=vec2pt.Vector)
# RESTRAINTS
pt = Point()
pln = Plane()
pt_2 = Point()
pln_2 = Plane()
pt_3 = Point(<point referenced from the Rhino model>)
youngs_modulus_of_elasticity_e = Slider(16708.921, range=0..50000)

# ----
# LOADS
# Loads can be single points or point collections.
# 
# New loads are added in the same manner as described above. Remember to increase the target integer in the path mapper component to the next unique integer.
# 
# Set the force in Newtons, and the direction of the force using X, Y and Z axis rotations.
# LOADS
# LOADS
pt_4 = Point(<point referenced from the Rhino model>)
x_axis_rotation = Slider(0, range=0..360)
y_axis_rotation = Slider(0, range=0..360)
z_axis_rotation = Slider(0, range=0..360)
newtons_3 = Slider(20, range=0..25000)
pt_5 = Point([<point referenced from the Rhino model> x5])
x_axis_rotation_2 = Slider(0, range=0..360)
y_axis_rotation_2 = Slider(0, range=0..360)
# MATERIALS
# & sections
newtons_4 = Slider(20, range=0..25000)
z_axis_rotation_2 = Slider(0, range=0..360)
cluster = Cluster(A=x_axis_rotation, G=pt_4, A_3=z_axis_rotation, A_2=y_axis_rotation, X=newtons_3, d3=pt_4)  # -> V, G_2, V_2, R
cluster_2 = Cluster(A=x_axis_rotation_2, G=pt_5, A_3=z_axis_rotation_2, A_2=y_axis_rotation_2, X=newtons_4, d3=pt_5)  # -> V, G_2, V_2, R
line = LineSDL(Start=pt_4, Direction=cluster.V, Length=expr("abs(L)/500", newtons_3))
line_2 = LineSDL(Start=pt_5, Direction=cluster_2.V, Length=expr("abs(L)/500", newtons_4))
vdis = VectorDisplay(Anchor=cluster.G_2, Vector=cluster.V_2)
vdis_2 = VectorDisplay(Anchor=cluster_2.G_2, Vector=cluster_2.V_2)
path_mapper = PathMapper(cluster.R, source="{0}", target="{0}")
path_mapper_2 = PathMapper(cluster_2.R, source="{0}", target="{1}")
merge = Merge(Data1=path_mapper, Data2=path_mapper_2)

coefficient = Slider(0.95, range=0..1)

# ----
# pre specified materials
youngs_modulus_of_elasticity_e_2 = Slider(1584.164, range=0..50000)
youngs_modulus_of_elasticity_e_3 = Slider(2768.327, range=0..50000)
# Materials & sections can be chosen from the list of prespecified materials or user defined.
# 
# Add new material in the same manner as described above.
# 
# All materials have by default 5 parameters.  However, these are not all used by each material. For example, membrane materials do not take a value for second moment of inertia.  In these cases, the set value is ignored.
youngs_modulus_of_elasticity_e_4 = Slider(3500, range=0..50000)
coefficient_2 = Slider(0.6, range=0..1)
second_moment_of_inertia_i = Slider(0.81, range=0..1000)
second_moment_of_inertia_i_2 = Slider(0.81, range=0..1000)
neutral_axis_distance = Slider(0.375, range=0..10)
neutral_axis_distance_2 = Slider(0.25, range=0..10)
second_moment_of_inertia_i_3 = Slider(0.785, range=0..1000)
coefficient_3 = Slider(1, range=0..1)
neutral_axis_distance_3 = Slider(1, range=0..10)
sectional_area_a = Slider(0.25, range=0..200)
sectional_area_a_2 = Slider(0.55, range=0..200)
sectional_area_a_3 = Slider(3.142, range=0..200)
user_material = PythonScript(
    NAME="MATERIAL TWO",
    E=youngs_modulus_of_elasticity_e_2,
    A=sectional_area_a,
    I=second_moment_of_inertia_i,
    C=coefficient,
    D=neutral_axis_distance)  # -> out, MAT
# ---------- user_material: Python ----------
output = []

output.append(NAME)
if E is not None:
    output.append(E)
else:
    output.append(1)
if A is not None:
    output.append(A)
else:
    output.append(1)
if I is not None:
    output.append(I)
else:
    output.append(1)
if C is not None:
    output.append(C)
else:
    output.append(1)
if D is not None:
    output.append(D)
else:
    output.append(1)

MAT = output
# ---------- end user_material ----------
user_material_2 = PythonScript(
    NAME="MATERIAL THREE",
    E=youngs_modulus_of_elasticity_e_3,
    A=sectional_area_a_2,
    I=second_moment_of_inertia_i_2,
    C=coefficient_2,
    D=neutral_axis_distance_2)  # -> out, MAT; same code as user_material
user_material_3 = PythonScript(
    NAME="MATERIAL ONE",
    E=youngs_modulus_of_elasticity_e_4,
    A=sectional_area_a_3,
    I=second_moment_of_inertia_i_3,
    C=coefficient_3,
    D=neutral_axis_distance_3)  # -> out, MAT
# ---------- user_material_3: Python ----------
output = []

output.append(NAME)
if E is not None:
    output.append(E)
else:
    output.append(-1)
if A is not None:
    output.append(A)
else:
    output.append(-1)
if I is not None:
    output.append(I)
else:
    output.append(-1)
if C is not None:
    output.append(C)
else:
    output.append(-1)
if D is not None:
    output.append(D)
else:
    output.append(-1)

MAT = output
# ---------- end user_material_3 ----------
list_2 = ValueList({"GFRP_D2": 0, "GFRP_D3": 1, "STEEL_D2": 2, "RATTAN_D6": 3, "RATTAN_D10": 4, "WOOD_2*20": 5, "MEMBRANE": 6, "PVC_D2": 7}, selected=["GFRP_D2", "GFRP_D3", "STEEL_D2", "RATTAN_D6", "RATTAN_D10", "WOOD_2*20", "MEMBRANE", "PVC_D2"])
path_mapper_3 = PathMapper(user_material.MAT, source="{0;0}", target="{1}")
path_mapper_4 = PathMapper(user_material_2.MAT, source="{0;0}", target="{2}")
path_mapper_5 = PathMapper(user_material_3.MAT, source="{0;0}", target="{0}")

coefficient_4 = Slider(0.9, range=0..1)
second_moment_of_inertia_i_4 = Slider(0.81, range=0..1000)
neutral_axis_distance_4 = Slider(0.25, range=0..10)
crv_2 = Curve()
crv_3 = Curve(<curve referenced from the Rhino model>)
pt_6 = Point()
pt_7 = Point(<point referenced from the Rhino model>)
sectional_area_a_4 = Slider(0.55, range=0..200)
pt_8 = Point(<point referenced from the Rhino model>)
# Line Constrained Pin Joints
pin_joints = Point([<point referenced from the Rhino model> x4])
vec = Vector(unit)
pt_9 = Point()
vec_2 = Vector()
merge_2 = Merge(Data1=vec, Data2=pt_8)
merge_3 = Merge(Data1=vec_2, Data2=pt_9)
path_mapper_6 = PathMapper(merge_2, source="{0}", target="{0}")
path_mapper_7 = PathMapper(merge_3, source="{0}", target="{1}")
panel_2 = Panel(pt)
crv_4 = Curve([<curve referenced from the Rhino model> x4])
user_material_4 = PythonScript(
    NAME="MATERIAL FOUR",
    E=youngs_modulus_of_elasticity_e,
    A=sectional_area_a_4,
    I=second_moment_of_inertia_i_4,
    C=coefficient_4,
    D=neutral_axis_distance_4)  # -> out, MAT; same code as user_material
crv_5 = Curve([<curve referenced from the Rhino model> x2])
crv_6 = Curve([<curve referenced from the Rhino model> x2])

# ----
# ELEMENTS
# Elements can be beam, truss or cable elements.
# 
# To make a new element collection, copy paste the naming panel, the curve collection and the path mapper (everything before the merge component). Increase the target value of the path mapper to the next unique integer.  Select new curves and name as appropriate.
# Beam Elements
panel_3 = Panel("MATERIAL ONE")
path_mapper_8 = PathMapper([panel_3, crv_6], source="{0}", target="{0}")
path_mapper_9 = PathMapper("STEEL_D2", source="{0}", target="{1}")
merge_4 = Merge(Data1=path_mapper_8, Data2=path_mapper_9)

crv_7 = Curve()
crv_8 = Curve([<curve referenced from the Rhino model> x3])
crv_9 = Curve([<curve referenced from the Rhino model> x8])

# ----
# Cable Elements
# (& membranes)
panel_4 = Panel("MATERIAL THREE")
path_mapper_10 = PathMapper([panel_4, crv_8], source="{0}", target="{0}")
path_mapper_11 = PathMapper(["MATERIAL THREE", crv_9], source="{0}", target="{1}")
merge_5 = Merge(Data1=path_mapper_10, Data2=path_mapper_11)

path_mapper_12 = PathMapper(["MATERIAL FOUR", crv_7], source="{0}", target="{2}")

# ----
# Truss Elements
panel_5 = Panel("MATERIAL THREE")
path_mapper_13 = PathMapper(panel_5, source="{0}", target="{0}")
path_mapper_14 = PathMapper("MATERIAL TWO", source="{0}", target="{1}")
merge_6 = Merge(Data1=path_mapper_13, Data2=path_mapper_14, Data3=path_mapper_12)

path_mapper_15 = PathMapper(user_material_4.MAT, source="{0;0}", target="{3}")
merge_7 = Merge(Data1=path_mapper_6, Data2=path_mapper_7)
panel_6 = Panel(merge_7)
merge_8 = Merge(Data1=path_mapper_5, Data2=path_mapper_3, Data3=path_mapper_4, Data4=path_mapper_15)
python_2 = PythonScript(preSpecified=list_2, userDefined=merge_8)  # -> out, a; inputs preSpecified: list, userDefined: tree
# ---------- python_2: Python ----------
from PreSpecMaterials import Materials
import clr
clr.AddReference("Grasshopper")
from Grasshopper.Kernel.Data import GH_Path
from Grasshopper import DataTree

PreSpecMatList = userDefined
exLength = PreSpecMatList.BranchCount

mat = Materials()

# I is the second moment of area 
#   http://en.wikipedia.org/wiki/Second_moment_of_area
#   http://en.wikipedia.org/wiki/List_of_area_moments_of_inertia
# A is the section area
# D is the distance to the neutral axis in the the direction in which I is computed

for preset in preSpecified:
    exLength += 1
    if preset == 0:#GFRP_D2
        for i in mat.gfrp(NAME = 'GFRP_D2', A = 3.1415, I = 0.78539, D = 1):
            PreSpecMatList.Add(i, GH_Path(exLength))
    elif preset == 1:#GFRP_D3
        for i in mat.gfrp(NAME = 'GFRP_D3', A = 7.068375, I = 3.976078, D = 1.5):
            PreSpecMatList.Add(i, GH_Path(exLength))
    elif preset ==2:#STEEL_D2
        for i in mat.steel(NAME = 'STEEL_D2', A = 3.1415, I = 0.78539, D = 1):
            PreSpecMatList.Add(i, GH_Path(exLength))
    elif preset ==3:#RATTAN_D6
        for i in mat.rattan(NAME = 'RATTAN_D6', A = 28.2735, I = 63.617251, D = 3):
            PreSpecMatList.Add(i, GH_Path(exLength))
    elif preset ==4:#RATTAN_D10
        for i in mat.rattan(NAME = 'RATTAN_D10', A = 78.5375, I = 490.873852, D = 5):
            PreSpecMatList.Add(i, GH_Path(exLength))
    elif preset ==5:#WOOD_2*20
        for i in mat.wood(NAME = 'WOOD_2x20', A = 40, I = 13.333333, D = 1):
            PreSpecMatList.Add(i, GH_Path(exLength))
    elif preset ==6:#MEMBRANE
        for i in mat.membrane(NAME = 'MEMBRANE', A = 0.01, C = 0.9):
            PreSpecMatList.Add(i, GH_Path(exLength))
    elif preset ==7:#PVC
        for i in mat.pvc(NAME = 'PVC_D2', A = 3.1415, I = 0.78539, D = 1):
            PreSpecMatList.Add(i, GH_Path(exLength))
        
        
        
a = PreSpecMatList
# ---------- end python_2 ----------
run = BooleanToggle(True)
reset = BooleanToggle(False)
adjust_forces = BooleanToggle(True)
step_size = Slider(500, range=1..50000)
timer = Timer(TimerInterval=2, Target=dynamic_relaxation_engine)

# ----
# Pin Joints
# Rail Constrained Pin Joints
# Plane Constrained Pin Joints
deplane = DeconstructPlane(Plane=pln)  # -> Origin, XAxis, YAxis, ZAxis
deplane_2 = DeconstructPlane(Plane=pln_2)  # -> Origin, XAxis, YAxis, ZAxis
merge_9 = Merge(Data1=crv_3, Data2=pt_7)
merge_10 = Merge(Data1=crv_2, Data2=pt_6)
path_mapper_16 = PathMapper(merge_9, source="{0}", target="{0}")
path_mapper_17 = PathMapper(merge_10, source="{0}", target="{1}")
merge_11 = Merge(Data1=path_mapper_16, Data2=path_mapper_17)

pt_10 = Point(deplane.ZAxis)
pt_11 = Point(deplane_2.ZAxis)

merge_12 = Merge(Data1=pt_11, Data2=pt_3)
merge_13 = Merge(Data1=pt_10, Data2=pt_2)
path_mapper_18 = PathMapper(merge_12, source="{0}", target="{0}")
path_mapper_19 = PathMapper(merge_13, source="{0}", target="{1}")
merge_14 = Merge(Data1=path_mapper_18, Data2=path_mapper_19)

panel_7 = Panel(merge_11)
dynamic_relaxation_engine = PythonScript(
    beams=merge_4,
    trusses=merge_6,
    cables=merge_5,
    loads=merge,
    pinnedPoints=pt,
    lineConstrainedPoints=merge_7,
    railConstrainedPoints=merge_11,
    planeConstrainedPoints=merge_14,
    materials=python_2.a,
    run=run,
    reset=reset,
    step=step_size,
    adjust=adjust_forces)  # -> out, beamsOUT, trussesOUT, cablesOUT, stressOUT, stressMinMax, loadsOUT, loadsDirOUT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; inputs beams: tree, trusses: tree, cables: tree, loads: tree of Point3d, pinnedPoints: list of Point3d, lineConstrainedPoints: tree of Point3d, railConstrainedPoints: tree, planeConstrainedPoints: tree of Point3d, materials: tree
# ---------- dynamic_relaxation_engine: Python ----------
import Rhino # this is all the Rhino common classes and stuff (documentation here: http://4.rhino3d.com/5/rhinocommon/)
import rhinoscriptsyntax as rs
import sys
#import DynamicRelaxationFaster as DynamicRelaxation
import DynamicRelaxation
from PreSpecMaterials import Materials
import itertools
import clr
clr.AddReference("Grasshopper")
from Grasshopper.Kernel.Data import GH_Path
from Grasshopper import DataTree
import System.Guid
"""This component takes as input different sets of lines to define a dynamic relaxation (DR) process to find their equilibrium position.

This is the first example of a (hopefully) running code.

There are of course several things that need to be done:
    
    TODO allow for different materials in same kind of elements (e.g. tow different bending stiffnesses) maybe as pairs sets [ [list,material],[otherlist]other material]]
    TODO have a way to define generic materials (young modulus E + section area A + second moment of inertia I)(as a python class?)
    TODO add load elements as triple [position, direction, value]

The code is heavily inspired by the TraerPhysics library for Processing by J. Traer and several amendments/improvements 
made by Guillaume Labelle and Julien Nembrini in TraerAnar as a link to the ANAR+ library (http://anar.ch) 

This code is copyrighted by Julien Nembrini and distributed open source in the sense of the Gnu GPL v3.0. 

"""

#@@@@@@@@@@@@@@@@@@@@@@@@@@@@@@@
#@@@@@@@@@@@@@@@@@@@@@@@@@@@@@@@
#@@@@@@@@@@@@@@@@@@@@@@@@@@@@@@@
#@@@@@@@@@@@@@@@@@@@@@@@@@@@@@@@

def makePtFromRhino(pt):
    return DynamicRelaxation.Point3D(pt.X,pt.Y,pt.Z)
    
def makePtsFromRhino(pts):
    a = []
    for pt in pts:
        a.append(makePtFromRhino(pt))
    return a
    
def makeVecfromPoint3D(p):
    return Rhino.Geometry.Point3d(p.x(),p.y(),p.z())

#@@@@@@@@@@@@@@@@@@@@@@@@@@@@@@@
#@@@@@@@@@@@@@@@@@@@@@@@@@@@@@@@
#@@@@@@@@@@@@@@@@@@@@@@@@@@@@@@@
#@@@@@@@@@@@@@@@@@@@@@@@@@@@@@@@

class CurveConstraint(object):
    def __init__(self,crv):
        self.curve = crv
        
    def setCrv(self, crv):
        self.curve = crv
        
    def apply(self,v):
        b,val = Rhino.Geometry.Curve.ClosestPoint(self.curve,makeVecfromPoint3D(v.position))
        if b:
            return makePtFromRhino(self.curve.PointAt(val))
        else :
            v.position

#adjustments
def resetCrv(crvs):
    pass

def resetLoad():
    for i in range(len(allLoads)):
        dir = loads.Branch(i)[0]
        force = loads.Branch(i)[1]
        for j in itertools.islice(allLoads[i],2,None):
            j.setForce(force.X)
            j.setDirection(makePtFromRhino(dir))

def resetMaterials():
    matName = []
    matEval = []
    matAval = []
    matIval = []
    matCval = []
    matDval = []

    for i in range(materials.BranchCount):
        matName.append (materials.Branch(i)[0])
        matEval.append (materials.Branch(i)[1])
        matAval.append (materials.Branch(i)[2])
        matIval.append (materials.Branch(i)[3])
        matCval.append (materials.Branch(i)[4])
        matDval.append (materials.Branch(i)[5])

    #### apply material adjustments to elements
    for bending in allBendings:
        for bend in bending:
            matSpec = bend.getMaterialName()
            bend.setEI( matEval[matName.index(matSpec)], matIval[matName.index(matSpec)] )
            bend.setES( matEval[matName.index(matSpec)], matAval[matName.index(matSpec)] )


#@@@@@@@@@@@@@@@@@@@@@@@@@@@@@@@
#@@@@@@@@@@@@@@@@@@@@@@@@@@@@@@@
#@@@@@@@@@@@@@@@@@@@@@@@@@@@@@@@
#@@@@@@@@@@@@@@@@@@@@@@@@@@@@@@@

print 'A prototype for dynamic relaxation in Rhino/GH/python. (c) Julien Nembrini'

#print sys.path

#@@@@@@@@@@@@@@@@@@@@@@@@@@@@@@@
#@@@@@@@@@@@@@@@@@@@@@@@@@@@@@@@
#@@@@@@@@@@@@@@@@@@@@@@@@@@@@@@@
#@@@@@@@@@@@@@@@@@@@@@@@@@@@@@@@

# Initialisation
if reset :

    # create particle system no drag no gravity
    ps = DynamicRelaxation.ParticleSystem()
    #ps = ParticleSystem(Vector3D(0,0,1), 0.5)
    #ps.setIntegrator(DynamicRelaxation.ParticleSystem.EULER)

    print ps

    #### materials
    matName = []
    matEval = []
    matAval = []
    matIval = []
    matCval = []
    matDval = []

    for i in range(materials.BranchCount):
        matName.append (materials.Branch(i)[0])
        matEval.append (materials.Branch(i)[1])
        matAval.append (materials.Branch(i)[2])
        matIval.append (materials.Branch(i)[3])
        matCval.append (materials.Branch(i)[4])
        matDval.append (materials.Branch(i)[5])

    #### bending elements
    allBendings = [] 
    allBendingsParts = [] 
    for i in range(beams.BranchCount):
        matSpec = beams.Branch(i)[0]
        if type (matSpec) == str:
            for j in itertools.islice(beams.Branch(i),1,None):
                if type(j) is System.Guid:
                    pts = rs.PolylineVertices(j)
                    if pts: 
                        #create the bending elements (registered automagically in ps)
                        parts,bends = DynamicRelaxation.makeBendingsFromList(ps, makePtsFromRhino(pts),matEval[matName.index(matSpec)],matIval[matName.index(matSpec)],matAval[matName.index(matSpec)], matDval[matName.index(matSpec)])
                        for bend in bends:
                            bend.setMaterialName(matSpec)
                        # keep a copy for display of the particles making a bending line
                        allBendingsParts.append(parts)
                        allBendings.append(bends)
        else: print 'problem with beam material definitions'
    print 'bendings :' + str(len(ps.bendings))

    #### elastic elements
    allElastics = [] 
    allElasticsParts = [] 
    
    for i in range(trusses.BranchCount):
        matSpec = trusses.Branch(i)[0]
        if type (matSpec) == str:
            for j in itertools.islice(trusses.Branch(i),1,None):
                if type(j) is System.Guid:
                    pts = rs.PolylineVertices(j)
                    if pts: 
                        #create the bending elements (registered automagically in ps)
                        parts,elas = DynamicRelaxation.makeElasticsFromList(ps, makePtsFromRhino(pts), matEval[matName.index(matSpec)], matAval[matName.index(matSpec)], 0,  matCval[matName.index(matSpec)])
                        # keep a copy for display of the particles making a bending line
                        allElasticsParts.append(parts)
                        allElastics.append(elas)
        else: print 'problem with truss material definitions'
    print 'trusses :' + str(len(ps.elastics))

    #### cables elements
    allCables = [] 
    allCablesParts = [] 

    for i in range(cables.BranchCount):
        matSpec = cables.Branch(i)[0]
        if type (matSpec) == str:
            for j in itertools.islice(cables.Branch(i),1,None):
                if type(j) is System.Guid:
                    pts = rs.PolylineVertices(j)
                    if pts: 
                        parts,cabls = DynamicRelaxation.makeCablesFromList(ps, makePtsFromRhino(pts), matEval[matName.index(matSpec)], matAval[matName.index(matSpec)], 0,  matCval[matName.index(matSpec)])
                        allCablesParts.append(parts)
                        allCables.append(cabls)
        else: print 'problem with cable material definitions'
    print 'cables :' + str(len(ps.cables))
    
    #### loads
    allLoads = [] 
    allLoadsParts = [] 

    for i in range(loads.BranchCount):
        dir = loads.Branch(i)[0]
        force = loads.Branch(i)[1]
        pts = []
        for j in itertools.islice(loads.Branch(i),2,None):
            if j is not None: 
                pts.append (j)
        parts,lds = DynamicRelaxation.makeLoadsFromList(ps, makePtsFromRhino(pts),makePtFromRhino(dir),force.X)
        allLoadsParts.append(parts)
        allLoads.append(lds)
        
    print 'loads :' + str(len(ps.loads))
    
    # TODO make a construction loop for the remaining kind of elements
    #DynamicRelaxation.makeAttractionsFromList(ps, makePtsFromRhino(pts),100)
    
    cPoints = []
    for pt in pinnedPoints:
        if pt is not None: cPoints.append (pt)
    if len(cPoints)>0:
        DynamicRelaxation.makeConstraintsFromList(ps,makePtsFromRhino(cPoints))
    
    # pin constrained points
    for pt in pinnedPoints:
        if pt is not None:
            ps.findParticleEqualToPoint(makePtFromRhino(pt)).makeFixed()
    print 'particles :' + str(len(ps.particles))

    #### line constrained points
    allLineConstraints = []
    for i in range(lineConstrainedPoints.BranchCount):
        if len(lineConstrainedPoints.Branch(i))>1 and lineConstrainedPoints.Branch(i)[0] is not None:
            vect = lineConstrainedPoints.Branch(i)[0]
            pts = []
            for j in itertools.islice(lineConstrainedPoints.Branch(i),1,None):
                if j is not None: 
                    pts.append (j)
            parts = DynamicRelaxation.makeConstraintsFromList(ps,makePtsFromRhino(pts),makePtFromRhino(vect), False)
            allRailConstraints.append(parts)
    
    #### rail constrained points
    allRailConstraints = [] 
    for i in range(railConstrainedPoints.BranchCount):
        if len(railConstrainedPoints.Branch(i))>1 and railConstrainedPoints.Branch(i)[1] is not None:
            rail = CurveConstraint(rs.coercecurve(railConstrainedPoints.Branch(i)[0]))
            pts = []
            for j in itertools.islice(railConstrainedPoints.Branch(i),1,None):
                if j is not None: 
                    pts.append (rs.coerce3dpoint(j))
            parts, springs = DynamicRelaxation.makeOutsideSpringConstraintsFromList(ps, makePtsFromRhino(pts),rail.apply, 1000, 0)
            allRailConstraints.append(parts)

    #### plane constrained points
    allPlaneConstraintPoints = [] 
    for i in range(planeConstrainedPoints.BranchCount):
        if len(planeConstrainedPoints.Branch(i))>1:
            plVect = makePtFromRhino(planeConstrainedPoints.Branch(i)[0])
            pts = []
            for j in itertools.islice(planeConstrainedPoints.Branch(i),1,None):
                if j is not None: 
                    pts.append (j)
            parts = DynamicRelaxation.makeConstraintsFromList(ps,makePtsFromRhino(pts),plVect)
            allPlaneConstraintPoints.append(parts)

    stepCount = 0
    
#@@@@@@@@@@@@@@@@@@@@@@@@@@@@@@@
#@@@@@@@@@@@@@@@@@@@@@@@@@@@@@@@
#@@@@@@@@@@@@@@@@@@@@@@@@@@@@@@@
#@@@@@@@@@@@@@@@@@@@@@@@@@@@@@@@

#adjustment of material parameters during simulation

if adjust:
    resetMaterials()
    resetLoad()
    #### TODO import other parameters

#@@@@@@@@@@@@@@@@@@@@@@@@@@@@@@@
#@@@@@@@@@@@@@@@@@@@@@@@@@@@@@@@
#@@@@@@@@@@@@@@@@@@@@@@@@@@@@@@@
#@@@@@@@@@@@@@@@@@@@@@@@@@@@@@@@

# Dynamic Relaxation step

if run:
    for i in range(10):
        ps.step(step)
    ps.stepRelax(step)
    stepCount += 1
    #print stepCount


#@@@@@@@@@@@@@@@@@@@@@@@@@@@@@@@
#@@@@@@@@@@@@@@@@@@@@@@@@@@@@@@@
#@@@@@@@@@@@@@@@@@@@@@@@@@@@@@@@
#@@@@@@@@@@@@@@@@@@@@@@@@@@@@@@@

# Display functions

#center = Rhino.Geometry.Point3d((supportPtsIn[0].X + supportPtsIn[1].X) * .5, (supportPtsIn[0].Y + supportPtsIn[1].Y) * .5, (supportPtsIn[0].Z + supportPtsIn[1].Z) * .5)

beamsOUT = DataTree[Rhino.Geometry.PolylineCurve]()
trussesOUT = DataTree[Rhino.Geometry.PolylineCurve]()
cablesOUT = DataTree[Rhino.Geometry.PolylineCurve]()
stressOUT = DataTree[float]()
stressSort = []
stressMinMax = []
loadsOUT = DataTree[Rhino.Geometry.Point3d]()
loadsDirOUT = DataTree[Rhino.Geometry.Vector3d]()
# compare bending force between top and bottom of arch 
for i in range(len(allBendings)):
    path = GH_Path(i)
    for j in range(0, len(allBendings[i])+1):
        if j == 0:
            tmpStress = allBendings[i][j].getStress()
        elif j == len(allBendings[i]):
            tmpStress = allBendings[i][j-1].getStress()
        else:
            tmpStress = (allBendings[i][j].getStress()+allBendings[i][j-1].getStress())*0.5
        stressOUT.Add(tmpStress, path)
        stressSort.append(tmpStress)

if len(stressSort)>0:
    stressSort.sort()
    stressMinMax.append(stressSort[0])
    stressMinMax.append(stressSort[-1])

for i in range(len(allBendingsParts)):
    path = GH_Path(i)
    parts = []
    for p in allBendingsParts[i] :
        part = Rhino.Geometry.Point3d(p.position.x(), p.position.y(), p.position.z())
        parts.append(part)
    beamsOUT.Add(Rhino.Geometry.PolylineCurve(parts), path)

for i in range(len(allElasticsParts)):
    path = GH_Path(i)
    parts = []
    for p in allElasticsParts[i] :
        part = Rhino.Geometry.Point3d(p.position.x(), p.position.y(), p.position.z())
        parts.append(part)
    trussesOUT.Add(Rhino.Geometry.PolylineCurve(parts), path)

for i in range(len(allCablesParts)):
    path = GH_Path(i)
    parts = []
    for p in allCablesParts[i]:
        part = Rhino.Geometry.Point3d(p.position.x(), p.position.y(), p.position.z())
        parts.append(part)
    cablesOUT.Add(Rhino.Geometry.PolylineCurve(parts), path)

particles = []
for p in ps.particles:
    part = Rhino.Geometry.Point3d(p.position.x(), p.position.y(), p.position.z())
    particles.append(part)

for i in range(len(allLoads)):
    path = GH_Path(i)
    parts = []
    for l in allLoads[i]: 
        p = l.getParticle()
        loadsOUT.Add(Rhino.Geometry.Point3d(p.position.x(), p.position.y(), p.position.z()), path)
        loadsDirOUT.Add(Rhino.Geometry.Vector3d(makeVecfromPoint3D(l.getDirection())), path)
#curveOut = Rhino.Geometry.PolylineCurve(pts)

stepCounter = stepCount
# ---------- end dynamic_relaxation_engine ----------
pt_12 = Point(dynamic_relaxation_engine.loadsOUT)
pt_13 = Point(dynamic_relaxation_engine.particles)
crv_10 = Curve(dynamic_relaxation_engine.trussesOUT)
crv_11 = Curve(dynamic_relaxation_engine.cablesOUT)
panel_8 = Panel(dynamic_relaxation_engine.stepCounter)
vdis_3 = VectorDisplay(Anchor=pt_12, Vector=dynamic_relaxation_engine.loadsDirOUT)
item = ListItem(List=dynamic_relaxation_engine.stressMinMax, Index=1, Wrap=True)
item_2 = ListItem(List=dynamic_relaxation_engine.stressMinMax, Index=0, Wrap=True)
gradient = Gradient(
    LowerLimit=item_2,
    UpperLimit=item,
    Parameter=dynamic_relaxation_engine.stressOUT,
    stops=[0: RGB(0, 0, 255), 0.494: RGB(255, 128, 0), 1: RGB(255, 0, 0)])
explode = Explode(Curve=dynamic_relaxation_engine.beamsOUT, Recursive=True)  # -> Segments, Vertices
preview = CustomPreview(Geometry=explode.Segments, Shader=gradient)

# ==== cluster Cluster
line = LineSDL(Start=Point(0, 0, 0), Direction=Vector(1, 0, 0), Length=1)
line_2 = LineSDL(Start=Point(0, 0, 0), Direction=Vector(0, 1, 0), Length=1)
line_3 = LineSDL(Start=Point(0, 0, 0), Direction=Vector(0, 0, 1), Length=1)
line_4 = LineSDL(Start=Point(0, 0, 0), Direction=Vector(0, 0, 1), Length=1)
A = ClusterInput()
X = ClusterInput()
vrot = Rotate(Vector=line_4, Axis=line, Angle=degrees(A))
vec = VectorXYZ(XComponent=X, YComponent=0, ZComponent=0)  # -> Vector, Length
A_2 = ClusterInput()
A_3 = ClusterInput()
vrot_2 = Rotate(Vector=vrot, Axis=line_2, Angle=degrees(A_2))
vrot_3 = Rotate(Vector=vrot_2, Axis=line_3, Angle=degrees(A_3))
G = ClusterInput()
rev = Reverse(Vector=vrot_3)
V = ClusterOutput(vrot_3)
d3 = ClusterInput()
move = Move(Geometry=G, Motion=vrot_3)  # -> Geometry, Transform
V_2 = ClusterOutput(rev)
merge = Merge(Data1=rev, Data2=vec.Vector, Data3=d3)
G_2 = ClusterOutput(move.Geometry)
R = ClusterOutput(merge)
