# Grasshopper definition DynamicRelaxation_adapt.gh (Grasshopper 0.9.64)
# plug-ins: Python Interpreter

list = ValueList({"Circular Solid": 1, "Circular Tube": 2, "Rectangular Solid": 3}, selected="Circular Tube")
trigger = Slider(100, range=0..1000)
newtons = Slider(10, range=0..25000)
newtons_2 = Slider(9935.225, range=0..25000)
python = PythonScript(trigger=trigger, before=newtons, after=newtons_2)  # -> out, a
# ---------- python: Python ----------
if x > trigger:
    a = after
else:
    a = before
# ---------- end python ----------
area_moments_of_inertia_calculator = PythonScript(
    type=list,
    innerRadius=Slider(2, range=0..10),
    outerRadius=Slider(3, range=0..10),
    width=Slider(0.25, range=0..10),
    height=Slider(0.25, range=0..10))  # -> out, I
# ---------- area_moments_of_inertia_calculator: Python ----------
import math

def circular(r):
    return (math.pi/4)*math.pow(r,4)
    
def circularTube(r1, r2):
    print math.pow(r2,4) - math.pow(r1, 4)
    return (math.pi/4)*(math.pow(r2,4) - math.pow(r1, 4))

def rectangle(w,h):
    return (w*math.pow(h,3))/12

if type == 1:
    I = circular(outerRadius)
elif type == 2:
    I = circularTube(innerRadius, outerRadius)
elif type == 3:
    I = rectangle(width, height)
# ---------- end area_moments_of_inertia_calculator ----------
panel = Panel(area_moments_of_inertia_calculator.I)
pln = Plane()
pt = Point()
pln_2 = Plane()
pt_2 = Point(<point referenced from the Rhino model>)
youngs_modulus_of_elasticity_e = Slider(16708.921, range=0..50000)
coefficient = Slider(0.95, range=0..1)

# ----
# pre specified materials
youngs_modulus_of_elasticity_e_2 = Slider(1584.164, range=0..50000)
youngs_modulus_of_elasticity_e_3 = Slider(2768.327, range=0..50000)
# Materials & sections can be chosen from the list of prespecified materials or user defined.
# 
# Add new material in the same manner as described above.
# 
# All materials have by default 5 parameters.  However, these are not all used by each material. For example, membrane materials do not take a value for second moment of inertia.  In these cases, the set value is ignored.
youngs_modulus_of_elasticity_e_4 = Slider(20000, range=0..50000)
coefficient_2 = Slider(0.5, range=0..1)
second_moment_of_inertia_i = Slider(0.81, range=0..1000)
second_moment_of_inertia_i_2 = Slider(0.81, range=0..1000)
neutral_axis_distance = Slider(0.375, range=0..10)
neutral_axis_distance_2 = Slider(0.25, range=0..10)
second_moment_of_inertia_i_3 = Slider(0.785, range=0..1000)
coefficient_3 = Slider(1, range=0..1)
neutral_axis_distance_3 = Slider(1, range=0..10)
sectional_area_a = Slider(0.25, range=0..200)
sectional_area_a_2 = Slider(0.55, range=0..200)
sectional_area_a_3 = Slider(3.142, range=0..200)
user_material = PythonScript(
    NAME="MATERIAL TWO",
    E=youngs_modulus_of_elasticity_e_2,
    A=sectional_area_a,
    I=second_moment_of_inertia_i,
    C=coefficient,
    D=neutral_axis_distance)  # -> out, MAT
# ---------- user_material: Python ----------
output = []

output.append(NAME)
if E is not None:
    output.append(E)
else:
    output.append(1)
if A is not None:
    output.append(A)
else:
    output.append(1)
if I is not None:
    output.append(I)
else:
    output.append(1)
if C is not None:
    output.append(C)
else:
    output.append(1)
if D is not None:
    output.append(D)
else:
    output.append(1)

MAT = output
# ---------- end user_material ----------
user_material_2 = PythonScript(
    NAME="MATERIAL THREE",
    E=youngs_modulus_of_elasticity_e_3,
    A=sectional_area_a_2,
    I=second_moment_of_inertia_i_2,
    C=coefficient_2,
    D=neutral_axis_distance_2)  # -> out, MAT; same code as user_material
user_material_3 = PythonScript(
    NAME="MATERIAL ONE",
    E=youngs_modulus_of_elasticity_e_4,
    A=sectional_area_a_3,
    I=second_moment_of_inertia_i_3,
    C=coefficient_3,
    D=neutral_axis_distance_3)  # -> out, MAT
# ---------- user_material_3: Python ----------
output = []

output.append(NAME)
if E is not None:
    output.append(E)
else:
    output.append(-1)
if A is not None:
    output.append(A)
else:
    output.append(-1)
if I is not None:
    output.append(I)
else:
    output.append(-1)
if C is not None:
    output.append(C)
else:
    output.append(-1)
if D is not None:
    output.append(D)
else:
    output.append(-1)

MAT = output
# ---------- end user_material_3 ----------
list_2 = ValueList({"GFRP_D2": 0, "GFRP_D3": 1, "STEEL_D2": 2, "RATTAN_D6": 3, "RATTAN_D10": 4, "WOOD_2*20": 5, "MEMBRANE": 6, "PVC_D2": 7}, selected=["GFRP_D2", "GFRP_D3", "STEEL_D2", "RATTAN_D6", "RATTAN_D10", "WOOD_2*20", "MEMBRANE", "PVC_D2"])
path_mapper = PathMapper(user_material.MAT, source="{0;0}", target="{1}")
path_mapper_2 = PathMapper(user_material_2.MAT, source="{0;0}", target="{2}")
path_mapper_3 = PathMapper(user_material_3.MAT, source="{0;0}", target="{0}")

coefficient_4 = Slider(0.9, range=0..1)
second_moment_of_inertia_i_4 = Slider(0.81, range=0..1000)
neutral_axis_distance_4 = Slider(0.25, range=0..10)
number_slider = Slider(0.681, range=0..1)
number_slider_2 = Slider(0.265, range=0..1)
# ELEMENTS
# Elements can be beam, truss or cable elements.
# 
# To make a new element collection, copy paste the naming panel, the curve collection and the path mapper (everything before the merge component). Increase the target value of the path mapper to the next unique integer.  Select new curves and name as appropriate.
number_slider_3 = Slider(0.29, range=0..1)

# ----
# LOADS
# LOADS
x_axis_rotation = Slider(270, range=0..360)
newtons_3 = Slider(20, range=0..25000)
# LOADS
pt_3 = Point(<point referenced from the Rhino model>)
y_axis_rotation = Slider(0, range=0..360)
# Loads can be single points or point collections.
# 
# New loads are added in the same manner as described above. Remember to increase the target integer in the path mapper component to the next unique integer.
# 
# Set the force in Newtons, and the direction of the force using X, Y and Z axis rotations.
z_axis_rotation = Slider(0, range=0..360)
pt_4 = Point([<point referenced from the Rhino model> x3])
x_axis_rotation_2 = Slider(0, range=0..360)
y_axis_rotation_2 = Slider(180, range=0..360)
z_axis_rotation_2 = Slider(0, range=0..360)
# MATERIALS
# & sections
newtons_4 = Slider(10, range=0..25000)
cluster = Cluster(A=x_axis_rotation, G=pt_3, A_3=z_axis_rotation, A_2=y_axis_rotation, X=newtons_3, d3=pt_3)  # -> V, G_2, V_2, R
cluster_2 = Cluster(A=x_axis_rotation_2, G=pt_4, A_3=z_axis_rotation_2, A_2=y_axis_rotation_2, X=newtons_4, d3=pt_4)  # -> V, G_2, V_2, R
line = LineSDL(Start=pt_3, Direction=cluster.V, Length=expr("abs(L)/500", newtons_3))
line_2 = LineSDL(Start=pt_4, Direction=cluster_2.V, Length=expr("abs(L)/500", newtons_4))
vdis = VectorDisplay(Anchor=cluster.G_2, Vector=cluster.V_2)
vdis_2 = VectorDisplay(Anchor=cluster_2.G_2, Vector=cluster_2.V_2)
path_mapper_4 = PathMapper(cluster.R, source="{0}", target="{0}")
path_mapper_5 = PathMapper(cluster_2.R, source="{0}", target="{1}")
merge = Merge(Data1=path_mapper_4, Data2=path_mapper_5)

crv = Curve()
crv_2 = Curve()
pt_5 = Point()
pt_6 = Point()
sectional_area_a_4 = Slider(0.55, range=0..200)
pt_7 = Point(<point referenced from the Rhino model>)
# RESTRAINTS
# Line Constrained Pin Joints
pin_joints = Point([<point referenced from the Rhino model> x3])
vec = Vector()
pt_8 = Point()
vec_2 = Vector()
merge_2 = Merge(Data1=vec, Data2=pt_7)
merge_3 = Merge(Data1=vec_2, Data2=pt_8)
crv_3 = Curve(<curve referenced from the Rhino model>)
number_slider_4 = Slider(7, range=6..18)
number_slider_5 = Slider(17, range=6..18)
number_slider_6 = Slider(14, range=6..18)
path_mapper_6 = PathMapper(merge_2, source="{0}", target="{0}")
path_mapper_7 = PathMapper(merge_3, source="{0}", target="{1}")
panel_2 = Panel(pin_joints)
eval = EvaluateCurve(Curve=reparameterize(crv_3), Parameter=number_slider)  # -> Point, Tangent, Angle
eval_2 = EvaluateCurve(Curve=reparameterize(crv_3), Parameter=number_slider_2)  # -> Point, Tangent, Angle
eval_3 = EvaluateCurve(Curve=reparameterize(crv_3), Parameter=number_slider_3)  # -> Point, Tangent, Angle
crv_4 = Curve(<curve referenced from the Rhino model>)
crv_5 = Curve([<curve referenced from the Rhino model> x4])
cp = ControlPoints(Curve=crv_4)  # -> Points, Weights, Knots
user_material_4 = PythonScript(
    NAME="MATERIAL FOUR",
    E=youngs_modulus_of_elasticity_e,
    A=sectional_area_a_4,
    I=second_moment_of_inertia_i_4,
    C=coefficient_4,
    D=neutral_axis_distance_4)  # -> out, MAT; same code as user_material
crv_6 = Curve([<curve referenced from the Rhino model> x2])
crv_7 = Curve([<curve referenced from the Rhino model> x3])
crv_8 = Curve([<curve referenced from the Rhino model> x8])

# ----
# Cable Elements
# (& membranes)
panel_3 = Panel("MATERIAL THREE")
path_mapper_8 = PathMapper([panel_3, crv_7], source="{0}", target="{0}")
path_mapper_9 = PathMapper(["MATERIAL THREE", crv_8], source="{0}", target="{1}")
merge_4 = Merge(Data1=path_mapper_8, Data2=path_mapper_9)

path_mapper_10 = PathMapper("MATERIAL FOUR", source="{0}", target="{2}")

# ----
# Truss Elements
panel_4 = Panel("MATERIAL THREE")
path_mapper_11 = PathMapper(panel_4, source="{0}", target="{0}")
path_mapper_12 = PathMapper("MATERIAL TWO", source="{0}", target="{1}")
merge_5 = Merge(Data1=path_mapper_11, Data2=path_mapper_12, Data3=path_mapper_10)

path_mapper_13 = PathMapper(user_material_4.MAT, source="{0;0}", target="{3}")
item = ListItem(List=cp.Points, Index=number_slider_4, Wrap=True)
item_2 = ListItem(List=cp.Points, Index=number_slider_5, Wrap=True)
item_3 = ListItem(List=cp.Points, Index=number_slider_6, Wrap=True)
merge_6 = Merge(Data1=path_mapper_6, Data2=path_mapper_7)
pt_9 = Point(<point referenced from the Rhino model>)
pt_10 = Point(<point referenced from the Rhino model>)
pt_11 = Point(<point referenced from the Rhino model>)
crv_9 = Curve(<curve referenced from the Rhino model>)
panel_5 = Panel(merge_6)
intcrv = Interpolate(Vertices=flatten([pt_9, eval.Point, item]), Degree=3, Periodic=False, KnotStyle=1)  # -> Curve, Length, Domain
intcrv_2 = Interpolate(Vertices=flatten([pt_10, eval_2.Point, item_2]), Degree=3, Periodic=False, KnotStyle=1)  # -> Curve, Length, Domain
intcrv_3 = Interpolate(Vertices=flatten([pt_11, eval_3.Point, item_3]), Degree=3, Periodic=False, KnotStyle=1)  # -> Curve, Length, Domain
merge_7 = Merge(Data1=path_mapper_3, Data2=path_mapper, Data3=path_mapper_2, Data4=path_mapper_13)
reb = RebuildCurve(Curve=[intcrv.Curve, intcrv_2.Curve, intcrv_3.Curve], Degree=1, Count=10, Tangents=False)
crv_10 = Curve(flatten([crv_9, reb]))

# ----
# Beam Elements
panel_6 = Panel("MATERIAL ONE")
path_mapper_14 = PathMapper([panel_6, crv_10], source="{0}", target="{0}")
path_mapper_15 = PathMapper("STEEL_D2", source="{0}", target="{1}")
merge_8 = Merge(Data1=path_mapper_14, Data2=path_mapper_15)

galapagos = Galapagos(
    fitness=item_4,
    gene=[number_slider_3, number_slider_2, number_slider, number_slider_6, number_slider_5, number_slider_4])
python_2 = PythonScript(preSpecified=list_2, userDefined=merge_7)  # -> out, a; inputs preSpecified: list, userDefined: tree
# ---------- python_2: Python ----------
from PreSpecMaterials import Materials
import clr
clr.AddReference("Grasshopper")
from Grasshopper.Kernel.Data import GH_Path
from Grasshopper import DataTree

PreSpecMatList = userDefined
exLength = PreSpecMatList.BranchCount

mat = Materials()

# I is the second moment of area 
#   http://en.wikipedia.org/wiki/Second_moment_of_area
#   http://en.wikipedia.org/wiki/List_of_area_moments_of_inertia
# A is the section area
# D is the distance to the neutral axis in the the direction in which I is computed

for preset in preSpecified:
    exLength += 1
    if preset == 0:#GFRP_D2
        for i in mat.gfrp(NAME = 'GFRP_D2', A = 3.1415, I = 0.78539, D = 1):
            PreSpecMatList.Add(i, GH_Path(exLength))
    elif preset == 1:#GFRP_D3
        for i in mat.gfrp(NAME = 'GFRP_D3', A = 7.068375, I = 3.976078, D = 1.5):
            PreSpecMatList.Add(i, GH_Path(exLength))
    elif preset ==2:#STEEL_D2
        for i in mat.steel(NAME = 'STEEL_D2', A = 3.1415, I = 0.78539, D = 1):
            PreSpecMatList.Add(i, GH_Path(exLength))
    elif preset ==3:#RATTAN_D6
        for i in mat.rattan(NAME = 'RATTAN_D6', A = 28.2735, I = 63.617251, D = 3):
            PreSpecMatList.Add(i, GH_Path(exLength))
    elif preset ==4:#RATTAN_D10
        for i in mat.rattan(NAME = 'RATTAN_D10', A = 78.5375, I = 490.873852, D = 5):
            PreSpecMatList.Add(i, GH_Path(exLength))
    elif preset ==5:#WOOD_2*20
        for i in mat.wood(NAME = 'WOOD_2x20', A = 40, I = 13.333333, D = 1):
            PreSpecMatList.Add(i, GH_Path(exLength))
    elif preset ==6:#MEMBRANE
        for i in mat.membrane(NAME = 'MEMBRANE', A = 0.01, C = 0.9):
            PreSpecMatList.Add(i, GH_Path(exLength))
    elif preset ==7:#PVC
        for i in mat.pvc(NAME = 'PVC_D2', A = 3.1415, I = 0.78539, D = 1):
            PreSpecMatList.Add(i, GH_Path(exLength))
        
        
        
a = PreSpecMatList
# ---------- end python_2 ----------
panel_7 = Panel("C:\Users\LKTAdmin\Documents\GitHub\CM_ACTIVATEDASSEMBLIES\stresstests\DynamicRelaxationComponentCode_adapt.py")
run = BooleanToggle(True)
reset = BooleanToggle(False)
adjust_forces = BooleanToggle(False)
step_size = Slider(200, range=1..50000)
timer = Timer(TimerInterval=2)
file = ReadFile(File=panel_7, PerLineParse=False)

# ----
# Pin Joints
# Rail Constrained Pin Joints
# Plane Constrained Pin Joints
deplane = DeconstructPlane(Plane=pln)  # -> Origin, XAxis, YAxis, ZAxis
deplane_2 = DeconstructPlane(Plane=pln_2)  # -> Origin, XAxis, YAxis, ZAxis
merge_9 = Merge(Data1=crv_2, Data2=pt_6)
merge_10 = Merge(Data1=crv, Data2=pt_5)
path_mapper_16 = PathMapper(merge_9, source="{0}", target="{0}")
path_mapper_17 = PathMapper(merge_10, source="{0}", target="{1}")
merge_11 = Merge(Data1=path_mapper_16, Data2=path_mapper_17)

pt_12 = Point(deplane.ZAxis)
pt_13 = Point(deplane_2.ZAxis)

merge_12 = Merge(Data1=pt_13, Data2=pt_2)
merge_13 = Merge(Data1=pt_12, Data2=pt)
path_mapper_18 = PathMapper(merge_12, source="{0}", target="{0}")
path_mapper_19 = PathMapper(merge_13, source="{0}", target="{1}")
merge_14 = Merge(Data1=path_mapper_18, Data2=path_mapper_19)

panel_8 = Panel(merge_11)
dynamic_relaxation_engine = PythonScript(
    Code=file,
    Beams=merge_8,
    Trusses=merge_5,
    Cables=merge_4,
    Loads=merge,
    PinnedPoints=pin_joints,
    LineConstrainedPoints=merge_6,
    RailConstrainedPoints=merge_11,
    PlaneConstrainedPoints=merge_14,
    Materials=python_2.a,
    Run=run,
    Reset=reset,
    Step=step_size,
    Adjust=adjust_forces)  # -> Out, BeamsOUT, TrussesOUT, CablesOUT, StressOUT, StressMinMax, LoadsOUT, LoadsDirOUT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
pt_14 = Point(dynamic_relaxation_engine.LoadsOUT)
pt_15 = Point(dynamic_relaxation_engine.Particles)
crv_11 = Curve(dynamic_relaxation_engine.TrussesOUT)
crv_12 = Curve(dynamic_relaxation_engine.CablesOUT)
panel_9 = Panel(dynamic_relaxation_engine.StepCounter)
vdis_3 = VectorDisplay(Anchor=pt_14, Vector=dynamic_relaxation_engine.LoadsDirOUT)
panel_10 = Panel(dynamic_relaxation_engine.Out)
panel_11 = Panel(dynamic_relaxation_engine.StressMinMax)
item_4 = ListItem(List=dynamic_relaxation_engine.StressMinMax, Index=1, Wrap=True)
item_5 = ListItem(List=dynamic_relaxation_engine.StressMinMax, Index=0, Wrap=True)
gradient = Gradient(
    LowerLimit=item_5,
    UpperLimit=item_4,
    Parameter=dynamic_relaxation_engine.StressOUT,
    stops=[0: RGB(0, 0, 255), 0.494: RGB(255, 128, 0), 1: RGB(255, 0, 0)])
explode = Explode(Curve=dynamic_relaxation_engine.BeamsOUT, Recursive=True)  # -> Segments, Vertices
preview = CustomPreview(Geometry=explode.Segments, Shader=gradient)

# ==== cluster Cluster
line = LineSDL(Start=Point(0, 0, 0), Direction=Vector(1, 0, 0), Length=1)
line_2 = LineSDL(Start=Point(0, 0, 0), Direction=Vector(0, 1, 0), Length=1)
line_3 = LineSDL(Start=Point(0, 0, 0), Direction=Vector(0, 0, 1), Length=1)
line_4 = LineSDL(Start=Point(0, 0, 0), Direction=Vector(0, 0, 1), Length=1)
A = ClusterInput()
X = ClusterInput()
vrot = Rotate(Vector=line_4, Axis=line, Angle=degrees(A))
vec = VectorXYZ(XComponent=X, YComponent=0, ZComponent=0)  # -> Vector, Length
A_2 = ClusterInput()
A_3 = ClusterInput()
vrot_2 = Rotate(Vector=vrot, Axis=line_2, Angle=degrees(A_2))
vrot_3 = Rotate(Vector=vrot_2, Axis=line_3, Angle=degrees(A_3))
G = ClusterInput()
rev = Reverse(Vector=vrot_3)
V = ClusterOutput(vrot_3)
d3 = ClusterInput()
move = Move(Geometry=G, Motion=vrot_3)  # -> Geometry, Transform
V_2 = ClusterOutput(rev)
merge = Merge(Data1=rev, Data2=vec.Vector, Data3=d3)
G_2 = ClusterOutput(move.Geometry)
R = ClusterOutput(merge)
